# Dynamo graph 000-Points and Vectors.dyn (Dynamo 2.13.1.3887)
# author: Autodesk

# group: CREATE Vectors
# note: Create Vectors via Code Blocks or Nodes
XAxis = Vector.XAxis()
YAxis = Vector.YAxis()
ZAxis = Vector.ZAxis()
code_block = CodeBlock { Point.ByCoordinates(0,0,0); Point.ByCoordinates(0,10,0); }
byTwoPoints = Vector.ByTwoPoints(start=code_block.out0, end=code_block.out1)
watch = Watch(byTwoPoints)
code_block_2 = CodeBlock { 0; 1; }
byCoordinates = Vector.ByCoordinates(x=code_block_2.out0, y=code_block_2.out0, z=code_block_2.out1)
watch_2 = Watch(byCoordinates)
define_z_vector_via_code_block = CodeBlock { Vector.ByCoordinates(0,0,1); Vector.ZAxis(); }
watch_3 = Watch(define_z_vector_via_code_block.out0)
watch_4 = Watch(define_z_vector_via_code_block.out1)

# group: CREATE Points
code_block_3 = CodeBlock { 0; }
byCoordinates_2 = Point.ByCoordinates(x=code_block_3, y=code_block_3, z=code_block_3)
watch_5 = Watch(byCoordinates_2)
world_ucs_origin_point = CodeBlock { Point.Origin(); }
watch_6 = Watch(world_ucs_origin_point)
origin = Point.Origin()
watch_7 = Watch(origin)
# note: Create Points via Code Blocks or Nodes
define_point_with_x_y_z_values = CodeBlock { Point.ByCoordinates(0,0,0); }
watch_8 = Watch(define_point_with_x_y_z_values)

# group: Select a Point
selectPoint = ASPointSelection()  # 1 picked in the model

# group: DERIVE Points and Vectors
# note: Derive Points from other points and/or vectors
code_block_4 = CodeBlock { Point.ByCoordinates(50,-10,20); Point.ByCoordinates(50,10,20); 20; }
scale = Vector.Scale(vector=watch_4, scale_factor=code_block_4.out2)
translate = Geometry.Translate(geometry=watch_7, direction=scale)
watch_9 = Watch(translate)
byStartPointEndPoint = Line.ByStartPointEndPoint(startPoint=code_block_4.out0, endPoint=code_block_4.out1)
orthoProjectPointToLine = AdvanceSteel.Nodes.Util.Geometry.OrthoProjectPointToLine(point=watch_8, line=byStartPointEndPoint)
watch_10 = Watch(orthoProjectPointToLine.FoundPoint)
getMidBetweenPoints = AdvanceSteel.Nodes.Util.Geometry.GetMidBetweenPoints(firstPoint=code_block_4.out0, secondPoint=code_block_4.out1)
watch_11 = Watch(getMidBetweenPoints)
watch_12 = Watch(orthoProjectPointToLine.IsOnLine)
translate_2 = Geometry.Translate(geometry=selectPoint, direction=scale)
watch_13 = Watch(translate_2)
