# Dynamo graph 001-Planes.dyn (Dynamo 3.7.0.11777)
# author: Autodesk

# group: DERIVE Planes
# note: Derive Points from other points and/or vectors
code_block = CodeBlock()
# ---------- code_block.designscript (6 lines) ----------
Point.ByCoordinates(50,50,20);
Point.ByCoordinates(50,10,20);
20;
Point.ByCoordinates(0,-100,0);
150;
Point.ByCoordinates(-100,-100,-100);
# ----------------------------------------
ZAxis = Vector.ZAxis()
byOriginNormal = Plane.ByOriginNormal(origin=code_block.out0, normal=ZAxis)
watch = Watch(byOriginNormal)
closestPointTo = Geometry.ClosestPointTo(geometry=watch)  # unwired: other
watch_2 = Watch(closestPointTo)
XAxis = Vector.XAxis()
getPlaneOffsetByCentre = AdvanceSteel.Nodes.Util.Geometry.GetPlaneOffsetByCentre(planeNormal=XAxis)  # unwired: centrePoint, distance
watch_3 = Watch(getPlaneOffsetByCentre.PlanePositive)

# group: CREATE Planes
world_ucs_origin_point = CodeBlock { Point.ByCoordinates(50,20,0); Point.ByCoordinates(70,30,0); Point.ByCoordinates(50,30,0); }
byThreePoints = Plane.ByThreePoints(origin=world_ucs_origin_point.out0, planePoint=world_ucs_origin_point.out1, xAxisPoint=world_ucs_origin_point.out2)
origin = Point.Origin()
watch_4 = Watch(origin)
watch_5 = Watch(world_ucs_origin_point.out0)
code_block_2 = CodeBlock { 0; }
# note: Create Points via Code Blocks or Nodes
byCoordinates = Point.ByCoordinates(x=code_block_2, y=code_block_2, z=code_block_2)
ZAxis_2 = Vector.ZAxis()
byOriginNormal_2 = Plane.ByOriginNormal(origin=byCoordinates, normal=ZAxis_2)
watch_6 = Watch(byOriginNormal_2)
