# Dynamo graph 007-Modifications.dyn (Dynamo 2.5.2.7915)

# group: SET PARAMETERS
# note: Set base parameters of Frame
code_block = CodeBlock()
# ---------- code_block.designscript (5 lines) ----------
Point.ByCoordinates(0,0,0);
Point.ByCoordinates(1500,0,0);
Point.ByCoordinates(1500,3000,0);
Point.ByCoordinates(0,3000,0);
Vector.ZAxis();
# ----------------------------------------
beamReferenceAxis = BeamRefAxisType("Upper Middle")

# group: CREATE BEAMS
byStartPointEndPoint = AdvanceSteel.Nodes.Beams.StraightBeam.ByStartPointEndPoint(start=code_block.out2, end=code_block.out3, orientation=code_block.out4, refAxis=beamReferenceAxis)
# note: Create 4 Beam from a Frame
byStartPointEndPoint_2 = AdvanceSteel.Nodes.Beams.StraightBeam.ByStartPointEndPoint(start=code_block.out0, end=code_block.out1, orientation=code_block.out4, refAxis=beamReferenceAxis)

# group: SET PARAMETERS
# note: Set base parameters of Plate
code_block_2 = CodeBlock()
# ---------- code_block_2.designscript (6 lines) ----------
CP1=Point.ByCoordinates(2000,-100,0);
CP2=Point.ByCoordinates(3600,-100,0);
CP3=Point.ByCoordinates(3600,3100,0);
CP4=Point.ByCoordinates(2000,3100,0);
Vector.ZAxis();
EdgeDistance=200;
# ----------------------------------------
code_block_3 = CodeBlock { Vector.XAxis(); }
list_create = List.Create(item0=code_block_2.CP1, item1=code_block_2.CP2, item2=code_block_2.CP3, item3=code_block_2.CP4, item4=code_block_2.CP1)
byPoints = Polygon.ByPoints(points=list_create)

getMidBetweenPoints = AdvanceSteel.Nodes.Util.Geometry.GetMidBetweenPoints(firstPoint=code_block_2.CP1, secondPoint=code_block_2.CP3)
list_create_2 = List.Create()  # unwired: item0, item1
code_block_4 = CodeBlock {  }

# group: ADDITIONAL PARAMETERS
# note: Additional Plate Properties for Creation - Plate Thickness / Model Role
plateProperties = ASPropertiesPlate("Plate Portioning")
code_block_5 = CodeBlock { 1; }
byNameAndValue = AdvanceSteel.Nodes.Property.ByNameAndValue(propertyName=plateProperties, value=code_block_5)
plateProperties_2 = ASPropertiesPlate("Thickness")
code_block_6 = CodeBlock { 25; }
byNameAndValue_2 = AdvanceSteel.Nodes.Property.ByNameAndValue(propertyName=plateProperties_2, value=code_block_6)

list_create_3 = List.Create(item0=byNameAndValue, item1=byNameAndValue_2)

# group: CREATE PLATE
# note: Create Plate on bottom portioning & 25mm Thick
byPolygon = AdvanceSteel.Nodes.Plates.Plate.ByPolygon(poly=byPoints, additionalPlateParameters=list_create_3)

# group: CREATE POLYCUT
# note: Create Plate Polycut
code_block_7 = CodeBlock { 500; 750; 10; }
byLengthAndWidth = AdvanceSteel.Nodes.Features.PlatePolycut.ByLengthAndWidth(element=byPolygon, length=code_block_7.out0, width=code_block_7.out0, xOffset=code_block_7.out1, yOffset=code_block_7.out1)

byPointAndNormal = AdvanceSteel.Nodes.Features.BeamPlaneCut.ByPointAndNormal()  # unwired: element, origin, normal
byEndValue = AdvanceSteel.Nodes.Features.BeamPlaneCut.ByEndValue()  # unwired: element, shorteningLength
code_block_8 = CodeBlock { 150; }
byStartValue = AdvanceSteel.Nodes.Features.BeamPlaneCut.ByStartValue(element=byStartPointEndPoint_2, shorteningLength=code_block_8)
byEndValue_2 = AdvanceSteel.Nodes.Features.BeamPlaneCut.ByEndValue(element=byStartPointEndPoint_2, shorteningLength=code_block_8)
