# Dynamo graph 009_StairTower.dyn (Dynamo 2.5.2.7915)

# group: Stair Details
code_block = CodeBlock { TowerLength=6000; TowerWidth=3000; Stair1Centres=900; StairWidth=750; TreadName="6_f325mpg 245x750"; }
code_block_2 = CodeBlock { Vector.XAxis(); Vector.YAxis(); Vector.ZAxis(); }
code_block_3 = CodeBlock { LowerLanding=1100; Rise=180; Run=240; TreadCount=10; }
list_create = List.Create(item0=code_block_3.LowerLanding, item1=code_block_3.Rise, item2=code_block_3.Run, item3=code_block_3.TreadCount)
code_block_4 = CodeBlock { LowerLanding=1300; Rise=180; Run=240; TreadCount=12; }
list_create_2 = List.Create(item0=code_block_4.LowerLanding, item1=code_block_4.Rise, item2=code_block_4.Run, item3=code_block_4.TreadCount)
code_block_5 = CodeBlock { LowerLanding=1500; Rise=180; Run=240; TreadCount=18; }
list_create_3 = List.Create(item0=code_block_5.LowerLanding, item1=code_block_5.Rise, item2=code_block_5.Run, item3=code_block_5.TreadCount)
list_create_4 = List.Create(item0=list_create, item1=list_create_2, item2=list_create_3)
watch = Watch(list_create_4)

# group: Bottom Building Base Geometry
XY = Plane.XY()
byWidthLength = Rectangle.ByWidthLength(plane=XY, width=code_block.TowerLength, length=code_block.TowerWidth)
points = Polygon.Points(polygon=byWidthLength)
watch_2 = Watch(points)

code_block_6 = CodeBlock { 2; 3; }
getItemAtIndex = List.GetItemAtIndex(list=watch, index=code_block_6.out0, lacing=Longest)
getItemAtIndex_2 = List.GetItemAtIndex(list=watch, index=code_block_6.out1, lacing=Longest)
code_block_7 = CodeBlock { 1; 2; }

# group: SET - Additional Beam Properties
code_block_8 = CodeBlock { "Horizontal_Beam"; "Steel"; }
byNameAndValue = AdvanceSteel.Nodes.Property.ByNameAndValue(value=code_block_8.out0)  # unwired: propertyName
byNameAndValue_2 = AdvanceSteel.Nodes.Property.ByNameAndValue(value=code_block_8.out1)  # unwired: propertyName
straightBeamProperties = ASPropertiesStraightBeam("Profile Name")
# note: Set or Override Parameter in Civil 3D
code_block_9 = CodeBlock { "AS-NZS Parallel Flange Channel"; "PFC 200"; }
createSectionString = AdvanceSteel.Nodes.Util.Beam.CreateSectionString(sectionType=code_block_9.out0, sectionSize=code_block_9.out1)
byNameAndValue_3 = AdvanceSteel.Nodes.Property.ByNameAndValue(propertyName=straightBeamProperties, value=createSectionString)
list_create_5 = List.Create(item0=byNameAndValue_3)

code_block_10 = CodeBlock { 0; }
code_block_11 = CodeBlock { 2; }
div = code_block.StairWidth / code_block_11
code_block_12 = CodeBlock { 0; 1; 2; }
takeEveryNthItem = List.TakeEveryNthItem(list=watch, n=code_block_12.out2, offset=code_block_12.out1)
watch_3 = Watch(takeEveryNthItem)
code_block_13 = CodeBlock { 0; }
getItemAtIndex_3 = List.GetItemAtIndex(list=watch_3, index=code_block_13, lacing=Longest)
code_block_14 = CodeBlock { 1; 2; true; 3; }
getrise_list_getitematindex = List.GetItemAtIndex(list=watch_3, index=code_block_14.out0, lacing=Longest)
getrun_list_getitematindex = List.GetItemAtIndex(list=watch_3, index=code_block_14.out1, lacing=Longest)
stairvector_vector_bycoordinates = Vector.ByCoordinates(x=getrise_list_getitematindex, y=code_block_13, z=getrun_list_getitematindex, normalized=code_block_14.out2)
code_block_15 = CodeBlock { 2; }
pow = Math.Pow(number=getrun_list_getitematindex, power=code_block_15)
pow_2 = Math.Pow(number=getrise_list_getitematindex, power=code_block_15)
add = pow + pow_2
distalongslopepertread_math_sqrt = Math.Sqrt(number=add)
nooftreads_list_getitematindex = List.GetItemAtIndex(list=watch_3, index=code_block_14.out3, lacing=Longest)
disttolanding = distalongslopepertread_math_sqrt * nooftreads_list_getitematindex
code_block_16 = CodeBlock { 0; }
code_block_17 = CodeBlock { Point.Origin(); }
code_block_18 = CodeBlock { 2; }
div_2 = code_block.TowerLength / code_block_18
getPlaneOffsetByCentre = AdvanceSteel.Nodes.Util.Geometry.GetPlaneOffsetByCentre(centrePoint=code_block_17, planeNormal=code_block_2.out0, distance=div_2)
firstItem = List.FirstItem(list=getPlaneOffsetByCentre.PlaneNegative)
beam_reference_axis = BeamRefAxisType("Upper Left")
code_block_19 = CodeBlock { 0; }
reverse = Vector.Reverse(vector=code_block_2.out0)
takeEveryNthItem_2 = List.TakeEveryNthItem(list=watch, n=code_block_12.out2, offset=code_block_12.out0)
watch_4 = Watch(takeEveryNthItem_2)
getItemAtIndex_4 = List.GetItemAtIndex(list=watch_4, index=code_block_13, lacing=Longest)
code_block_20 = CodeBlock { 0; }
code_block_21 = CodeBlock { 1; 2; true; 3; }
getrise_list_getitematindex_2 = List.GetItemAtIndex(list=watch_4, index=code_block_21.out0, lacing=Longest)
sub = code_block_20 - getrise_list_getitematindex_2
getrun_list_getitematindex_2 = List.GetItemAtIndex(list=watch_4, index=code_block_21.out1, lacing=Longest)
stairvector_vector_bycoordinates_2 = Vector.ByCoordinates(x=sub, y=code_block_13, z=getrun_list_getitematindex_2, normalized=code_block_21.out2)
code_block_22 = CodeBlock { 2; }
pow_3 = Math.Pow(number=getrun_list_getitematindex_2, power=code_block_22)
pow_4 = Math.Pow(number=getrise_list_getitematindex_2, power=code_block_22)
add_2 = pow_3 + pow_4
distalongslopepertread_math_sqrt_2 = Math.Sqrt(number=add_2)
nooftreads_list_getitematindex_2 = List.GetItemAtIndex(list=watch_4, index=code_block_21.out3, lacing=Longest)
disttolanding_2 = distalongslopepertread_math_sqrt_2 * nooftreads_list_getitematindex_2
lastItem = List.LastItem(list=getPlaneOffsetByCentre.PlaneNegative)
code_block_23 = CodeBlock { 1; }
code_block_24 = CodeBlock { 1; }
code_block_25 = CodeBlock { 1; }
code_block_26 = CodeBlock { 0; }

# group: Create Columns
beam_reference_axis_2 = BeamRefAxisType("Middle Middle")

# group: Geometry for the Floor Steel
code_block_27 = CodeBlock { 2; 3; }
getItemAtIndex_5 = List.GetItemAtIndex(list=watch_2, index=code_block_27.out0)
getItemAtIndex_6 = List.GetItemAtIndex(list=watch_2, index=code_block_27.out1)
getMidBetweenPoints = AdvanceSteel.Nodes.Util.Geometry.GetMidBetweenPoints(firstPoint=getItemAtIndex_5, secondPoint=getItemAtIndex_6)

# group: Determine Levels of Stair Tower
mul = getItemAtIndex * getItemAtIndex_2
code_block_28 = CodeBlock { 1; }
count = List.Count(list=mul)
sequence = Sequence(start=code_block_28, amount=count, step=code_block_28)
takeItems = List.TakeItems(list=mul, amount=sequence)
sum = Math.Sum(values=takeItems)
translate = Geometry.Translate(geometry=getMidBetweenPoints, direction=code_block_2.out2, distance=sum)
watch_5 = Watch(sum)

addItemToFront = List.AddItemToFront(item=getMidBetweenPoints, list=translate)
watch_6 = Watch(addItemToFront)
count_2 = List.Count(list=watch_6)
slice = List.Slice(list=watch_6, start=code_block_7.out0, end=count_2, step=code_block_7.out1)
translate_2 = Geometry.Translate(geometry=slice, direction=code_block_2.out0, distance=code_block.TowerLength)
lastItem_2 = List.LastItem(list=translate_2)

# group (continued): Create Columns
Z = Point.Z(point=lastItem_2)
byStartPointDirectionLength = AdvanceSteel.Nodes.Beams.StraightBeam.ByStartPointDirectionLength(start=watch_2, direction=code_block_2.out2, orientation=code_block_2.out0, refAxis=beam_reference_axis_2, length=Z)

# group (continued): Geometry for the Floor Steel
translate_3 = Geometry.Translate(geometry=watch_2, direction=code_block_2.out2, distance=watch_5)
watch_7 = Watch(translate_3)
flatten = List.Flatten(list=watch_7)

# group: Create Floor Edge Beams
Z_2 = Point.Z(point=flatten)
sortByKey = List.SortByKey(list=flatten, keys=Z_2)
watch_8 = Watch(sortByKey.sorted_list)
code_block_29 = CodeBlock { 4; }
chop = List.Chop(list=watch_8, lengths=code_block_29)
firstItem_2 = List.FirstItem(list=chop, lacing=Longest)
addItemToEnd = List.AddItemToEnd(item=firstItem_2, list=chop, lacing=Longest)
code_block_30 = CodeBlock { 0; }
removeItemAtIndex = List.RemoveItemAtIndex(list=addItemToEnd, indices=code_block_30, lacing=Longest)
watch_9 = Watch(removeItemAtIndex)
beam_reference_axis_3 = BeamRefAxisType("Upper Middle")
byStartPointEndPoint = AdvanceSteel.Nodes.Beams.StraightBeam.ByStartPointEndPoint(start=chop, end=watch_9, orientation=code_block_2.out2, refAxis=beam_reference_axis_3)

slice_2 = List.Slice(list=watch_6, start=code_block_10, end=count_2, step=code_block_7.out1)
watch_points_on_left_side = Watch(slice_2)
getPlaneOffsetByCentre_2 = AdvanceSteel.Nodes.Util.Geometry.GetPlaneOffsetByCentre(centrePoint=getMidBetweenPoints, planeNormal=code_block_2.out1, distance=code_block.Stair1Centres)
origin = Plane.Origin(plane=getPlaneOffsetByCentre_2.PlaneNegative)
getPlaneOffsetByCentre_3 = AdvanceSteel.Nodes.Util.Geometry.GetPlaneOffsetByCentre(centrePoint=origin, planeNormal=code_block_2.out1, distance=div)
closestPointTo = Geometry.ClosestPointTo(geometry=watch_points_on_left_side, other=getPlaneOffsetByCentre_3.PlaneNegative)
watch_10 = Watch(closestPointTo)

# group: Lower Stringers Near Side of X
translate_4 = Geometry.Translate(geometry=watch_10, direction=code_block_2.out0, distance=getItemAtIndex_3)
beam_reference_axis_4 = BeamRefAxisType("Upper Left")
byStartPointEndPoint_2 = AdvanceSteel.Nodes.Beams.StraightBeam.ByStartPointEndPoint(start=watch_10, end=translate_4, orientation=code_block_2.out2, refAxis=beam_reference_axis_4, additionalBeamParameters=list_create_5)

# group: Stringer Creation
getPointFromEnd = AdvanceSteel.Nodes.Util.Beam.GetPointFromEnd(steelObject=byStartPointEndPoint_2)
translate_5 = Geometry.Translate(geometry=getPointFromEnd, direction=stairvector_vector_bycoordinates, distance=disttolanding)
beam_reference_axis_5 = BeamRefAxisType("Upper Left")
byStartPointEndPoint_3 = AdvanceSteel.Nodes.Beams.StraightBeam.ByStartPointEndPoint(start=getPointFromEnd, end=translate_5, orientation=code_block_2.out2, refAxis=beam_reference_axis_5, additionalBeamParameters=list_create_5)

getItemAtIndex_7 = List.GetItemAtIndex(list=byStartPointEndPoint_3, index=code_block_16, lacing=Longest)
setBeamCrossSectionMirrored = AdvanceSteel.Nodes.Util.Beam.SetBeamCrossSectionMirrored(steelObject=getItemAtIndex_7)
getPointFromEnd_2 = AdvanceSteel.Nodes.Util.Beam.GetPointFromEnd(steelObject=byStartPointEndPoint_3)
closestPointTo_2 = Geometry.ClosestPointTo(geometry=getPointFromEnd_2, other=firstItem)
byStartPointEndPoint_4 = AdvanceSteel.Nodes.Beams.StraightBeam.ByStartPointEndPoint(start=getPointFromEnd_2, end=closestPointTo_2, orientation=code_block_2.out2, refAxis=beam_reference_axis, additionalBeamParameters=list_create_5)
getItemAtIndex_8 = List.GetItemAtIndex(list=byStartPointEndPoint_4, index=code_block_19, lacing=Longest)
setBeamCrossSectionMirrored_2 = AdvanceSteel.Nodes.Util.Beam.SetBeamCrossSectionMirrored(steelObject=getItemAtIndex_8)
watch_points_on_right_side = Watch(translate_2)
closestPointTo_3 = Geometry.ClosestPointTo(geometry=watch_points_on_right_side, other=getPlaneOffsetByCentre_3.PlanePositive)
firstItem_3 = List.FirstItem(list=closestPointTo_3)
watch_11 = Watch(firstItem_3)

# group: Lower Stringer Far Side of X
translate_6 = Geometry.Translate(geometry=watch_11, direction=reverse, distance=getItemAtIndex_4)
beam_reference_axis_6 = BeamRefAxisType("Upper Left")
byStartPointEndPoint_5 = AdvanceSteel.Nodes.Beams.StraightBeam.ByStartPointEndPoint(start=watch_11, end=translate_6, orientation=code_block_2.out2, refAxis=beam_reference_axis_6, additionalBeamParameters=list_create_5)

# group: Stringer Creation
getPointFromEnd_3 = AdvanceSteel.Nodes.Util.Beam.GetPointFromEnd(steelObject=byStartPointEndPoint_5)
translate_7 = Geometry.Translate(geometry=getPointFromEnd_3, direction=stairvector_vector_bycoordinates_2, distance=disttolanding_2)
beam_reference_axis_7 = BeamRefAxisType("Upper Left")
byStartPointEndPoint_6 = AdvanceSteel.Nodes.Beams.StraightBeam.ByStartPointEndPoint(start=getPointFromEnd_3, end=translate_7, orientation=code_block_2.out2, refAxis=beam_reference_axis_7, additionalBeamParameters=list_create_5)

# group: Top Landing Left Side
getPointFromEnd_4 = AdvanceSteel.Nodes.Util.Beam.GetPointFromEnd(steelObject=byStartPointEndPoint_6)
closestPointTo_4 = Geometry.ClosestPointTo(geometry=getPointFromEnd_4, other=lastItem)
beam_reference_axis_8 = BeamRefAxisType("Upper Left")
byStartPointEndPoint_7 = AdvanceSteel.Nodes.Beams.StraightBeam.ByStartPointEndPoint(start=getPointFromEnd_4, end=closestPointTo_4, orientation=code_block_2.out2, refAxis=beam_reference_axis_8, additionalBeamParameters=list_create_5)

getItemAtIndex_9 = List.GetItemAtIndex(list=byStartPointEndPoint_7, index=code_block_23)
setBeamCrossSectionMirrored_3 = AdvanceSteel.Nodes.Util.Beam.SetBeamCrossSectionMirrored(steelObject=getItemAtIndex_9)
getItemAtIndex_10 = List.GetItemAtIndex(list=byStartPointEndPoint_6, index=code_block_24)
setBeamCrossSectionMirrored_4 = AdvanceSteel.Nodes.Util.Beam.SetBeamCrossSectionMirrored(steelObject=getItemAtIndex_10)
getItemAtIndex_11 = List.GetItemAtIndex(list=byStartPointEndPoint_5, index=code_block_25)
setBeamCrossSectionMirrored_5 = AdvanceSteel.Nodes.Util.Beam.SetBeamCrossSectionMirrored(steelObject=getItemAtIndex_11)
getItemAtIndex_12 = List.GetItemAtIndex(list=byStartPointEndPoint_2, index=code_block_26, lacing=Longest)
setBeamCrossSectionMirrored_6 = AdvanceSteel.Nodes.Util.Beam.SetBeamCrossSectionMirrored(steelObject=getItemAtIndex_12)
