# Dynamo graph AnchorBolts.dyn (Dynamo 2.5.2.7915)

# group: GET
# note: Get information / data from Civil 3D

# group: DATA IN
# note: Import information / data from others

# group: PROCESS
# note: Dynamo data manipulation

# group: GEOM
# note: Dynamo geometry creation

# group: TEMP
# note: Work in progress / To delete

# group: SET
# note: Set or Override Parameter in Civil 3D

# group: DATA OUT
# note: Export information / data to others

# group: CREATE
# note: Create object in Civil 3D

code_block = CodeBlock { "MuS"; "4.6"; "HOLDING DOWN BOLTS"; 300; }
code_block_2 = CodeBlock()
# ---------- code_block_2.designscript (3 lines) ----------
CoordinateSystem.ByOriginVectors(Point.Origin(), Vector.XAxis(), Vector.YAxis(), Vector.ZAxis());
Point.Origin();
Vector.ZAxis();
# ----------------------------------------
byOriginNormal = Plane.ByOriginNormal(origin=code_block_2.out1, normal=code_block_2.out2)
code_block_3 = CodeBlock { 300; 300; }
byWidthLength = Rectangle.ByWidthLength(plane=byOriginNormal, width=code_block_3.out0, length=code_block_3.out1)
code_block_4 = CodeBlock { 500; 650; 20; 0; -1; 1; }
byRectanglarByCS = AdvanceSteel.Nodes.Plates.Plate.ByRectanglarByCS(coordinateSystem=code_block_2.out0, length=code_block_4.out0, width=code_block_4.out1, thickness=code_block_4.out2, side=code_block_4.out3, corner=code_block_4.out4)
byRectanglarByCS_2 = AdvanceSteel.Nodes.Plates.Plate.ByRectanglarByCS(coordinateSystem=code_block_2.out0, length=code_block_4.out0, width=code_block_4.out1, thickness=code_block_4.out2, side=code_block_4.out5, corner=code_block_4.out4)
list_create = List.Create(item0=byRectanglarByCS, item1=byRectanglarByCS_2)
bolt_connection_type = BoltConnectionType("InShop")
anchor_bolt_properties = ASPropertiesAnchorBolt("Anchor Orientation")
code_block_5 = CodeBlock { 20; 2; 2; true; }
createParameter = AdvanceSteel.Nodes.Util.Properties.CreateParameter(selectedKey=anchor_bolt_properties, propertyValue=code_block_5.out3)
list_create_2 = List.Create(item0=createParameter)
byRectangle = AdvanceSteel.Nodes.ConnectionObjects.Anchors.RectangularAnchorPattern.ByRectangle(rectangle=byWidthLength, objectsToConnect=list_create, BoltConnectionType=bolt_connection_type, ListofAdditionalAnchorBoltParameters=list_create_2)
code_block_6 = CodeBlock()
# ---------- code_block_6.designscript (3 lines) ----------
CoordinateSystem.ByOriginVectors(Point.ByCoordinates(1500,0,0), Vector.XAxis(), Vector.YAxis(), Vector.ZAxis());
Point.ByCoordinates(1500,0,0);
Vector.ZAxis();
# ----------------------------------------
byOriginNormal_2 = Plane.ByOriginNormal(origin=code_block_6.out1, normal=code_block_6.out2)
code_block_7 = CodeBlock { 300; 300; }
byWidthLength_2 = Rectangle.ByWidthLength(plane=byOriginNormal_2, width=code_block_7.out0, length=code_block_7.out1)
code_block_8 = CodeBlock { 500; 650; 20; 0; -1; 1; }
byRectanglarByCS_3 = AdvanceSteel.Nodes.Plates.Plate.ByRectanglarByCS(coordinateSystem=code_block_6.out0, length=code_block_8.out0, width=code_block_8.out1, thickness=code_block_8.out2, side=code_block_8.out3, corner=code_block_8.out4)
byRectanglarByCS_4 = AdvanceSteel.Nodes.Plates.Plate.ByRectanglarByCS(coordinateSystem=code_block_6.out0, length=code_block_8.out0, width=code_block_8.out1, thickness=code_block_8.out2, side=code_block_8.out5, corner=code_block_8.out4)
list_create_3 = List.Create(item0=byRectanglarByCS_3, item1=byRectanglarByCS_4)
bolt_connection_type_2 = BoltConnectionType("InShop")
atCentrePoint = AdvanceSteel.Nodes.ConnectionObjects.Anchors.RectangularAnchorPattern.AtCentrePoint(connectionPoint=code_block_6.out1, boltCS=code_block_6.out0, objectsToConnect=list_create_3, BoltConnectionType=bolt_connection_type_2)
code_block_9 = CodeBlock { 20; 3; 4; 150; 200; }
code_block_10 = CodeBlock { "MuS"; "4.6"; "HOLDING DOWN BOLTS"; 300; }
code_block_11 = CodeBlock { "MuS"; "4.6"; "HOLDING DOWN BOLTS"; 300; }
code_block_12 = CodeBlock { Point.ByCoordinates(1500,1500,0); 600; Vector.ZAxis(); 1500; 20; 0; 1; -1; }
byCenterPointRadius = Circle.ByCenterPointRadius(centerPoint=code_block_12.out0, radius=code_block_12.out1)
code_block_13 = CodeBlock { Vector.XAxis(); }
byRectanglarByPointandNormal = AdvanceSteel.Nodes.Plates.Plate.ByRectanglarByPointandNormal(origin=code_block_12.out0, normal=code_block_12.out2, length=code_block_12.out3, width=code_block_12.out3, thickness=code_block_12.out4, side=code_block_12.out5, corner=code_block_12.out7)
byRectanglarByPointandNormal_2 = AdvanceSteel.Nodes.Plates.Plate.ByRectanglarByPointandNormal(origin=code_block_12.out0, normal=code_block_12.out2, length=code_block_12.out3, width=code_block_12.out3, thickness=code_block_12.out4, side=code_block_12.out6, corner=code_block_12.out7)
list_create_4 = List.Create(item0=byRectanglarByPointandNormal, item1=byRectanglarByPointandNormal_2)
bolt_connection_type_3 = BoltConnectionType("InShop")
anchor_bolt_properties_2 = ASPropertiesAnchorBolt("No of Anchor Circle")
code_block_14 = CodeBlock { 20; 7; 300; }
createParameter_2 = AdvanceSteel.Nodes.Util.Properties.CreateParameter(selectedKey=anchor_bolt_properties_2, propertyValue=code_block_14.out1)
list_create_5 = List.Create(item0=createParameter_2)
byCircle = AdvanceSteel.Nodes.ConnectionObjects.Anchors.CircularAnchorPattern.ByCircle(circle=byCenterPointRadius, referenceVector=code_block_13, objectsToConnect=list_create_4, AnchorBoltConnectionType=bolt_connection_type_3, ListofAdditionalAnchorBoltParameters=list_create_5)
anchor_orientation_type = AnchorOrientationType("Normal Orientation")
setAnchorBoltOrientation = AdvanceSteel.Nodes.Util.Properties.SetAnchorBoltOrientation(anchorBolts=byCircle, orientation=anchor_orientation_type)
code_block_15 = CodeBlock {  }
