# Dynamo graph Beam3.dyn (Dynamo 2.5.2.7915)

# group: NOTES - D4C3D
# note: DESIGN GRAPH STANDARDS
# Author:		Jowenn S. Lua
# Date Created:	10 August 2019
# Date Updated:	4 September 2020
# Version:		004
# DESIGN GRAPH GUIDELINES
# 1. Color code your blocks according to this guide.
# 2. Add grouping with name and description.
# 3. Add notes to explain each critical node process.
# 4. Rename Input / Output / Code Blocks nodes and add suffix to data they carry.
# 5. Align nodes to make it neat.
# 6. Save the graph as Manual instead of Automatic.

# group: PROCESS
# note: Dynamo data manipulation

# group: DATA IN
# note: Import information / data from others

# group: GEOM
# note: Dynamo geometry creation

# group: GET
# note: Get information / data from Civil 3D

# group: TEMP
# note: Work in progress / To delete

# group: SET
# note: Set or Override Parameter in Civil 3D

# group: DATA OUT
# note: Export information / data to others

# group: CREATE
# note: Create object in Civil 3D

# group: GRAPH INFO
# note: ________________________________________________________
# Dynamo Core Ver: 	2.4.1.6394
# Dynamo Civil 3D Ver: 	2.4.1.2161
# Package Used: 		Civil 3D Toolkit
# Custom Nodes Used: 	None
# Graph Function:
# 1. ???
# 2. ???
# 3. ???
# Created By: 		Jowenn S. Lua
# Date Created: 		September 2020
# Updated By:
# Date Modified:

code_block = CodeBlock { Point.ByCoordinates(0,0,0); Point.ByCoordinates(1001,1200,0); Point.ByCoordinates(2001,2000,0); Vector.ZAxis(); }
beam_reference_axis = BeamRefAxisType("Upper Middle")
code_block_2 = CodeBlock { true; }
byStartPointEndPoint = AdvanceSteel.Nodes.Beams.BentBeam.ByStartPointEndPoint(start=code_block.out0, end=code_block.out2, ptOnArc=code_block.out1, orientation=code_block.out3, refAxis=beam_reference_axis, crossSectionMirror=code_block_2)
code_block_3 = CodeBlock { 2; }
code_block_4 = CodeBlock { "beams"; }
code_block_5 = CodeBlock { Point.ByCoordinates(0,0,0); Point.ByCoordinates(2001,1200,0); Point.ByCoordinates(3001,2000,0); Vector.ZAxis(); }
byThreePoints = Arc.ByThreePoints(firstPoint=code_block_5.out0, secondPoint=code_block_5.out1, thirdPoint=code_block_5.out2)
beam_reference_axis_2 = BeamRefAxisType("Upper Middle")
bent_beam_properties = ASPropertiesBentBeam("Select Bent Beam Property...")
code_block_6 = CodeBlock { "Lindab Z Profiles"; "ZUni 35025"; }
createSectionString = AdvanceSteel.Nodes.Util.Beam.CreateSectionString(sectionType=code_block_6.out0, sectionSize=code_block_6.out1)
byNameAndValue = AdvanceSteel.Nodes.Property.ByNameAndValue(propertyName=bent_beam_properties, value=createSectionString)
list_create = List.Create(item0=byNameAndValue)
byArc = AdvanceSteel.Nodes.Beams.BentBeam.ByArc(arc=byThreePoints, orientation=code_block_5.out3, refAxis=beam_reference_axis_2, additionalBeamParameters=list_create)
code_block_7 = CodeBlock { "Lindab Z Profiles"; "ZUni 35030"; }
createSectionString_2 = AdvanceSteel.Nodes.Util.Beam.CreateSectionString(sectionType=code_block_7.out0, sectionSize=code_block_7.out1)
