# Dynamo graph BeamData.dyn (Dynamo 2.5.2.7915)

getSteelObjectsByType = ASSelectObjecTypes("Straight Beam")
bodyResolutions = BodyResolution("Detailed")
getBeamData = AdvanceSteel.Nodes.Util.Beam.GetBeamData(steelObject=getSteelObjectsByType, bodyResolutionForLength=bodyResolutions)
watch = Watch(getBeamData.beamData)
watch_2 = Watch(getBeamData.ExactWeight)
watch_3 = Watch(getBeamData.PaintArea)
watch_4 = Watch(getBeamData.WeightPerUnit)
watch_5 = Watch(getBeamData.ProfileType)
watch_6 = Watch(getBeamData.ProfileTypeCode)
getBeamSawInformation = AdvanceSteel.Nodes.Util.Beam.GetBeamSawInformation(steelObject=getSteelObjectsByType)
list_create = List.Create(item0=getBeamSawInformation.beamSawCutInformation, item1=getBeamSawInformation.FlangeAngleAtStart, item2=getBeamSawInformation.WebAngleAtStart, item3=getBeamSawInformation.FlangeAngleAtEnd, item4=getBeamSawInformation.WebAngleAtEnd)
watch_7 = Watch(list_create)
