# Dynamo graph Beams2.dyn (Dynamo 2.5.2.7915)

code_block = CodeBlock { Point.ByCoordinates(0,0,0); Point.ByCoordinates(2000,2000,2000); Vector.ZAxis(); }
byStartPointEndPoint = AdvanceSteel.Nodes.Beams.TaperedBeam.ByStartPointEndPoint(end=code_block.out1, vOrientation=code_block.out2)  # unwired: start
code_block_2 = CodeBlock { "Compound2U"; "Default"; }
createSectionString = AdvanceSteel.Nodes.Util.BeamSection.CreateSectionString(sectionType=code_block_2.out0, sectionSize=code_block_2.out1)
code_block_3 = CodeBlock { "TaperedBeam"; "Default"; }
createSectionString_2 = AdvanceSteel.Nodes.Util.BeamSection.CreateSectionString(sectionType=code_block_3.out0, sectionSize=code_block_3.out1)
setSection = AdvanceSteel.Nodes.Util.BeamSection.SetSection(sectionName=createSectionString_2)  # unwired: beamElement
code_block_4 = CodeBlock { Point.ByCoordinates(0,0,0); Point.ByCoordinates(0,2000,0); Vector.ZAxis(); }
code_block_5 = CodeBlock { "Compound2UToe"; "Default CISC"; }
createSectionString_3 = AdvanceSteel.Nodes.Util.BeamSection.CreateSectionString(sectionType=code_block_5.out0, sectionSize=code_block_5.out1)
byStartPointEndPoint_2 = AdvanceSteel.Nodes.Beams.CompoundBeam.ByStartPointEndPoint(end=code_block_4.out1, vOrientation=code_block_4.out2, sectionName=createSectionString_3)  # unwired: start
code_block_6 = CodeBlock { Point.ByCoordinates(0,0,0); Point.ByCoordinates(0,2000,2000); Vector.ZAxis(); }
code_block_7 = CodeBlock { "Compound2UToe"; "Default CISC"; "Default"; }
createSectionString_4 = AdvanceSteel.Nodes.Util.BeamSection.CreateSectionString(sectionType=code_block_7.out0, sectionSize=code_block_7.out1)
byStartPointEndPoint_3 = AdvanceSteel.Nodes.Beams.CompoundBeam.ByStartPointEndPoint(end=code_block_6.out1, vOrientation=code_block_6.out2, sectionName=createSectionString_4)  # unwired: start
code_block_8 = CodeBlock { Point.ByCoordinates(0,0,0); Point.ByCoordinates(2000,0,0); Vector.ZAxis(); }
code_block_9 = CodeBlock { "WeldedHalfColumn"; "Default"; }
createSectionString_5 = AdvanceSteel.Nodes.Util.BeamSection.CreateSectionString(sectionType=code_block_9.out0, sectionSize=code_block_9.out1)
byStartPointEndPoint_4 = AdvanceSteel.Nodes.Beams.CompoundBeam.ByStartPointEndPoint(end=code_block_8.out1, vOrientation=code_block_8.out2, sectionName=createSectionString_5)  # unwired: start
code_block_10 = CodeBlock { Point.ByCoordinates(0,0,0); Point.ByCoordinates(1000,1200,0); Point.ByCoordinates(2000,2000,0); Vector.ZAxis(); }
byStartPointEndPoint_5 = AdvanceSteel.Nodes.Beams.BentBeam.ByStartPointEndPoint(end=code_block_10.out2, ptOnArc=code_block_10.out1, orientation=code_block_10.out3)  # unwired: start
code_block_11 = CodeBlock { Point.ByCoordinates(0,0,0); Point.ByCoordinates(0,0,2000); Vector.ZAxis(); }
byStartPointEndPoint_6 = AdvanceSteel.Nodes.Beams.StraightBeam.ByStartPointEndPoint(end=code_block_11.out1, orientation=code_block_11.out2)  # unwired: start
createSectionString_6 = AdvanceSteel.Nodes.Util.BeamSection.CreateSectionString(sectionType=code_block_7.out0, sectionSize=code_block_7.out2)
setSection_2 = AdvanceSteel.Nodes.Util.BeamSection.SetSection(sectionName=createSectionString_6)  # unwired: beamElement
code_block_12 = CodeBlock { "WeldedHollow"; "Default"; }
createSectionString_7 = AdvanceSteel.Nodes.Util.BeamSection.CreateSectionString(sectionType=code_block_12.out0, sectionSize=code_block_12.out1)
setSection_3 = AdvanceSteel.Nodes.Util.BeamSection.SetSection(sectionName=createSectionString_7)  # unwired: beamElement
code_block_13 = CodeBlock { "Lindab Z Profiles"; "ZUni 35030"; }
createSectionString_8 = AdvanceSteel.Nodes.Util.BeamSection.CreateSectionString(sectionType=code_block_13.out0, sectionSize=code_block_13.out1)
setSection_4 = AdvanceSteel.Nodes.Util.BeamSection.SetSection(sectionName=createSectionString_8)  # unwired: beamElement
code_block_14 = CodeBlock { "AISC 14.1 Angle equal"; "L4X4X7/16"; }
createSectionString_9 = AdvanceSteel.Nodes.Util.BeamSection.CreateSectionString(sectionType=code_block_14.out0, sectionSize=code_block_14.out1)
setSection_5 = AdvanceSteel.Nodes.Util.BeamSection.SetSection(sectionName=createSectionString_9)  # unwired: beamElement
setSection_6 = AdvanceSteel.Nodes.Util.BeamSection.SetSection(sectionName=createSectionString_3)  # unwired: beamElement

# group: 2 Point , By Line & Point in Direction With Model Role and Section Size
code_block_15 = CodeBlock { Point.ByCoordinates(0,0,1001); Point.ByCoordinates(2000,0,100); Vector.ZAxis(); "Bar"; Vector.XAxis(); }
code_block_16 = CodeBlock { Point.ByCoordinates(0,0,0); Point.ByCoordinates(2001,0,0); Vector.ZAxis(); "Horizontal_Beam"; }
code_block_17 = CodeBlock { "AISC 14.1 Angle equal"; "L4X4X7/16"; }
createSectionString_10 = AdvanceSteel.Nodes.Util.BeamSection.CreateSectionString(sectionType=code_block_17.out0, sectionSize=code_block_17.out1)
byStartPointEndPoint_7 = AdvanceSteel.Nodes.Beams.StraightBeam.ByStartPointEndPoint(start=code_block_15.out0, end=code_block_15.out1, orientation=code_block_16.out2, modelRole=code_block_16.out3, sectionName=createSectionString_10)  # unwired: refAxis
code_block_18 = CodeBlock { 5000; }
byStartPointDirectionLength = AdvanceSteel.Nodes.Beams.StraightBeam.ByStartPointDirectionLength(start=code_block_16.out0, direction=code_block_15.out2, orientation=code_block_15.out4, length=code_block_18)
byStartPointDirectionLength_2 = AdvanceSteel.Nodes.Beams.StraightBeam.ByStartPointDirectionLength(start=code_block_16.out1, direction=code_block_15.out2, orientation=code_block_15.out4, length=code_block_18, modelRole=code_block_15.out3, sectionName=createSectionString_10)  # unwired: rotation, refAxis, crossSectionMirror
byStartPointEndPoint_8 = Line.ByStartPointEndPoint(startPoint=code_block_16.out0, endPoint=code_block_15.out1)
code_block_19 = CodeBlock { Vector.YAxis(); }
byLine = AdvanceSteel.Nodes.Beams.StraightBeam.ByLine(line=byStartPointEndPoint_8, orientation=code_block_19, modelRole=code_block_16.out3, sectionName=createSectionString_10)  # unwired: refAxis

code_block_20 = CodeBlock { Line.ByStartPointEndPoint(Point.ByCoordinates(0,0,0),Point.ByCoordinates(2000,0,0)); }
