# Dynamo graph Bolts2.dyn (Dynamo 2.5.2.7915)

# group: GET
# note: Get information / data from Civil 3D

# group: DATA IN
# note: Import information / data from others

# group: PROCESS
# note: Dynamo data manipulation

# group: GEOM
# note: Dynamo geometry creation

# group: TEMP
# note: Work in progress / To delete

# group: SET
# note: Set or Override Parameter in Civil 3D

# group: DATA OUT
# note: Export information / data to others

# group: CREATE
# note: Create object in Civil 3D

code_block = CodeBlock { Point.ByCoordinates(1500,1500,0); 600; Vector.ZAxis(); 1500; 20; 0; 1; -1; Vector.XAxis(); }
byCenterPointRadius = Circle.ByCenterPointRadius(centerPoint=code_block.out0, radius=code_block.out1)
byRectanglarByPointandNormal = AdvanceSteel.Nodes.Plates.Plate.ByRectanglarByPointandNormal(origin=code_block.out0, normal=code_block.out2, length=code_block.out3, width=code_block.out3, thickness=code_block.out4, side=code_block.out5, corner=code_block.out7)
byRectanglarByPointandNormal_2 = AdvanceSteel.Nodes.Plates.Plate.ByRectanglarByPointandNormal(origin=code_block.out0, normal=code_block.out2, length=code_block.out3, width=code_block.out3, thickness=code_block.out4, side=code_block.out6, corner=code_block.out7)
list_create = List.Create(item0=byRectanglarByPointandNormal, item1=byRectanglarByPointandNormal_2)
bolt_connection_type = BoltConnectionType("InShop")
advance_steel_bolt_property = ASPropertiesBolts("Bolt Inverted")
code_block_2 = CodeBlock { true; }
byNameAndValue = AdvanceSteel.Nodes.Util.Property.ByNameAndValue(propertyType=advance_steel_bolt_property, propertyValue=code_block_2)
advance_steel_bolt_property_2 = ASPropertiesBolts("No of Bolts Circle")
code_block_3 = CodeBlock { 6; }
byNameAndValue_2 = AdvanceSteel.Nodes.Util.Property.ByNameAndValue(propertyType=advance_steel_bolt_property_2, propertyValue=code_block_3)
list_create_2 = List.Create(item0=byNameAndValue, item1=byNameAndValue_2)
byCircle = AdvanceSteel.Nodes.ConnectionObjects.Bolts.CircularBoltPattern.ByCircle(circle=byCenterPointRadius, referenceVector=code_block.out8, objectsToConnect=list_create, boltConnectionType=bolt_connection_type, additionalBoltParameters=list_create_2)

# group: Rectangular Pattern at a point
code_block_4 = CodeBlock()
# ---------- code_block_4.designscript (3 lines) ----------
CoordinateSystem.ByOriginVectors(Point.ByCoordinates(1500,0,0), Vector.XAxis(), Vector.YAxis(), Vector.ZAxis());
Point.ByCoordinates(1500,0,0);
Vector.ZAxis();
# ----------------------------------------
code_block_5 = CodeBlock { 500; 650; 20; 0; -1; 1; 3; }
byRectanglarByCS = AdvanceSteel.Nodes.Plates.Plate.ByRectanglarByCS(coordinateSystem=code_block_4.out0, length=code_block_5.out0, width=code_block_5.out1, thickness=code_block_5.out2, side=code_block_5.out3, corner=code_block_5.out4)
byRectanglarByCS_2 = AdvanceSteel.Nodes.Plates.Plate.ByRectanglarByCS(coordinateSystem=code_block_4.out0, length=code_block_5.out0, width=code_block_5.out1, thickness=code_block_5.out2, side=code_block_5.out5, corner=code_block_5.out4)
list_create_3 = List.Create(item0=byRectanglarByCS, item1=byRectanglarByCS_2)
bolt_connection_type_2 = BoltConnectionType("Site Drill")
advance_steel_bolt_property_3 = ASPropertiesBolts("Bolt Assembly")
code_block_6 = CodeBlock { "MuS"; "8.8"; "AS 1252"; }
byNameAndValue_3 = AdvanceSteel.Nodes.Util.Property.ByNameAndValue(propertyType=advance_steel_bolt_property_3, propertyValue=code_block_6.out0)
advance_steel_bolt_property_4 = ASPropertiesBolts("Grade")
byNameAndValue_4 = AdvanceSteel.Nodes.Util.Property.ByNameAndValue(propertyType=advance_steel_bolt_property_4, propertyValue=code_block_6.out1)
advance_steel_bolt_property_5 = ASPropertiesBolts("Standard")
byNameAndValue_5 = AdvanceSteel.Nodes.Util.Property.ByNameAndValue(propertyType=advance_steel_bolt_property_5, propertyValue=code_block_6.out2)
list_create_4 = List.Create(item0=byNameAndValue_3, item1=byNameAndValue_4, item2=byNameAndValue_5)
atCentrePoint = AdvanceSteel.Nodes.ConnectionObjects.Bolts.RectangularBoltPattern.AtCentrePoint(connectionPoint=code_block_4.out1, boltCS=code_block_4.out0, noOfBoltsX=code_block_5.out6, objectsToConnect=list_create_3, boltConnectionType=bolt_connection_type_2, additionalBoltParameters=list_create_4)

code_block_7 = CodeBlock { "MuS"; "4.6"; "AS 1111"; }
code_block_8 = CodeBlock { 20; 7; }
code_block_9 = CodeBlock { 300; }

# group: Rectangular pattern and Rectangle
code_block_10 = CodeBlock()
# ---------- code_block_10.designscript (3 lines) ----------
CoordinateSystem.ByOriginVectors(Point.Origin(), Vector.XAxis(), Vector.YAxis(), Vector.ZAxis());
Point.Origin();
Vector.ZAxis();
# ----------------------------------------
byOriginNormal = Plane.ByOriginNormal(origin=code_block_10.out1, normal=code_block_10.out2)
code_block_11 = CodeBlock { 300; 300; 5; }
byWidthLength = Rectangle.ByWidthLength(plane=byOriginNormal, width=code_block_11.out0, length=code_block_11.out1)
code_block_12 = CodeBlock { 500; 650; 25; 0; -1; 1; }
byRectanglarByCS_3 = AdvanceSteel.Nodes.Plates.Plate.ByRectanglarByCS(coordinateSystem=code_block_10.out0, length=code_block_12.out0, width=code_block_12.out1, thickness=code_block_12.out2, side=code_block_12.out3, corner=code_block_12.out4)
byRectanglarByCS_4 = AdvanceSteel.Nodes.Plates.Plate.ByRectanglarByCS(coordinateSystem=code_block_10.out0, length=code_block_12.out0, width=code_block_12.out1, thickness=code_block_12.out2, side=code_block_12.out5, corner=code_block_12.out4)
list_create_5 = List.Create(item0=byRectanglarByCS_3, item1=byRectanglarByCS_4)
bolt_connection_type_3 = BoltConnectionType("InShop")
advance_steel_bolt_property_6 = ASPropertiesBolts("Bolt Standard")
code_block_13 = CodeBlock { "MuS"; "8.8"; "AS 1252"; }
byNameAndValue_6 = AdvanceSteel.Nodes.Util.Property.ByNameAndValue(propertyType=advance_steel_bolt_property_6, propertyValue=code_block_13.out2)
advance_steel_bolt_property_7 = ASPropertiesBolts("Bolt Grade")
byNameAndValue_7 = AdvanceSteel.Nodes.Util.Property.ByNameAndValue(propertyType=advance_steel_bolt_property_7, propertyValue=code_block_13.out1)
advance_steel_bolt_property_8 = ASPropertiesBolts("Bolt Assembly")
byNameAndValue_8 = AdvanceSteel.Nodes.Util.Property.ByNameAndValue(propertyType=advance_steel_bolt_property_8, propertyValue=code_block_13.out0)
list_create_6 = List.Create(item0=byNameAndValue_6, item1=byNameAndValue_7, item2=byNameAndValue_8)
byRectangle = AdvanceSteel.Nodes.ConnectionObjects.Bolts.RectangularBoltPattern.ByRectangle(rectangle=byWidthLength, noOfBoltsX=code_block_11.out2, objectsToConnect=list_create_5, boltConnectionType=bolt_connection_type_3, additionalBoltParameters=list_create_6)
code_block_14 = CodeBlock { 20; 2; 2; }
advance_steel_bolt_property_9 = ASPropertiesBolts("Bolt Inverted")
code_block_15 = CodeBlock { true; }
byNameAndValue_9 = AdvanceSteel.Nodes.Util.Property.ByNameAndValue(propertyType=advance_steel_bolt_property_9, propertyValue=code_block_15)
