# Dynamo graph Bridge.dyn (Dynamo 1.0.0.1531)

# group: Input values
width = CodeBlock { 5000; }
length = CodeBlock { 15000; }
height_difference_at_ends = CodeBlock { 2000; }
height = CodeBlock { 2500; }
divisions = CodeBlock()
# ---------- divisions.designscript (3 lines) ----------
def divisions(){
  return=10;
};
# ----------------------------------------

code_block = CodeBlock(x=width) { -x/2; }
byCoordinates = Point.ByCoordinates(y=code_block)
code_block_2 = CodeBlock(x=length) { x; }
byCoordinates_2 = Point.ByCoordinates(x=code_block_2, y=code_block, z=height_difference_at_ends)
byStartPointEndPoint = Line.ByStartPointEndPoint(startPoint=byCoordinates, endPoint=byCoordinates_2)
code_block_3 = CodeBlock(x=width) { x/2; }
byCoordinates_3 = Point.ByCoordinates(y=code_block_3)
byCoordinates_4 = Point.ByCoordinates(x=length, y=code_block_3, z=height_difference_at_ends)
byStartPointEndPoint_2 = Line.ByStartPointEndPoint(startPoint=byCoordinates_3, endPoint=byCoordinates_4)
ZAxis = Vector.ZAxis()
code_block_4 = CodeBlock(x=height) { x; }
translate = Geometry.Translate(geometry=byStartPointEndPoint, direction=ZAxis, distance=code_block_4)
translate_2 = Geometry.Translate(geometry=byStartPointEndPoint_2, direction=ZAxis, distance=code_block_4)

# group: Lateral beams
bottom_lines = List.Create(byStartPointEndPoint, byStartPointEndPoint_2)
startPoint = Curve.StartPoint(bottom_lines)
endPoint = Curve.EndPoint(bottom_lines)
XAxis = Vector.XAxis()
byStartPointEndPoint_3 = AdvanceSteel.Nodes.Beams.StraightBeam.ByStartPointEndPoint(startPoint, endPoint, XAxis)
top_lines = List.Create(translate, translate_2)
startPoint_2 = Curve.StartPoint(top_lines)
endPoint_2 = Curve.EndPoint(top_lines)
XAxis_2 = Vector.XAxis()
byStartPointEndPoint_4 = AdvanceSteel.Nodes.Beams.StraightBeam.ByStartPointEndPoint(startPoint_2, endPoint_2, XAxis_2)
code_block_5 = CodeBlock { 0..1..#divisions(); }
pointAtParameter = Curve.PointAtParameter(curve=bottom_lines, param=code_block_5, lacing=CrossProduct)
pointAtParameter_2 = Curve.PointAtParameter(curve=top_lines, param=code_block_5, lacing=CrossProduct)
XAxis_3 = Vector.XAxis()
byStartPointEndPoint_5 = AdvanceSteel.Nodes.Beams.StraightBeam.ByStartPointEndPoint(pointAtParameter, pointAtParameter_2, XAxis_3)
code_block_6 = CodeBlock(x=byStartPointEndPoint_5) { x[0]; 1; "Right side vertical bracing"; x[1]; 1; "Left side vertical bracing"; }
setUserAttribute = AdvanceSteel.Nodes.Util.UserAttribute.SetUserAttribute(code_block_6.out0, code_block_6.out1, code_block_6.out2)
setUserAttribute_2 = AdvanceSteel.Nodes.Util.UserAttribute.SetUserAttribute(code_block_6.out3, code_block_6.out4, code_block_6.out5)
code_block_7 = CodeBlock { -1; }
shiftIndices = List.ShiftIndices(amount=code_block_7)
map = List.Map(list=pointAtParameter_2, f_x=shiftIndices)
keep_connection_between_first = BoolSelector(false)  # "Keep connection between first and last points?"
formula = Formula("if(keep, 0, -1)", keep=keep_connection_between_first, lacing=CrossProduct)
dropItems = List.DropItems(amount=formula)
map_2 = List.Map(list=map, f_x=dropItems)
dropItems_2 = List.DropItems(amount=formula)
map_3 = List.Map(list=pointAtParameter, f_x=dropItems_2)
XAxis_4 = Vector.XAxis()
byStartPointEndPoint_6 = AdvanceSteel.Nodes.Beams.StraightBeam.ByStartPointEndPoint(map_2, map_3, XAxis_4)
code_block_8 = CodeBlock(x=byStartPointEndPoint_6) { x[0]; 1; "Right side forward diagonal bracing"; x[1]; 1; "Left side forward diagonal bracing"; }
setUserAttribute_3 = AdvanceSteel.Nodes.Util.UserAttribute.SetUserAttribute(code_block_8.out0, code_block_8.out1, code_block_8.out2)
setUserAttribute_4 = AdvanceSteel.Nodes.Util.UserAttribute.SetUserAttribute(code_block_8.out3, code_block_8.out4, code_block_8.out5)
code_block_9 = CodeBlock { 1; }
shiftIndices_2 = List.ShiftIndices(amount=code_block_9)
map_4 = List.Map(list=pointAtParameter_2, f_x=shiftIndices_2)
formula_2 = Formula("if(keep, 0, 1)", keep=keep_connection_between_first)
dropItems_3 = List.DropItems(amount=formula_2)
map_5 = List.Map(list=map_4, f_x=dropItems_3)
dropItems_4 = List.DropItems(amount=formula_2)
map_6 = List.Map(list=pointAtParameter, f_x=dropItems_4)
XAxis_5 = Vector.XAxis()
byStartPointEndPoint_7 = AdvanceSteel.Nodes.Beams.StraightBeam.ByStartPointEndPoint(map_5, map_6, XAxis_5)
code_block_10 = CodeBlock(x=byStartPointEndPoint_7) { x[0]; 1; "Right side backward diagonal bracing"; x[1]; 1; "Left side backward diagonal bracing"; }
setUserAttribute_5 = AdvanceSteel.Nodes.Util.UserAttribute.SetUserAttribute(code_block_10.out0, code_block_10.out1, code_block_10.out2)
setUserAttribute_6 = AdvanceSteel.Nodes.Util.UserAttribute.SetUserAttribute(code_block_10.out3, code_block_10.out4, code_block_10.out5)

byTwoPoints = Vector.ByTwoPoints(start=byCoordinates, end=byCoordinates_2)
YAxis = Vector.YAxis()
cross = Vector.Cross(vector=byTwoPoints, cross=YAxis)

# group: Top and bottom beams
create = List.Create(translate, byStartPointEndPoint)
code_block_11 = CodeBlock { 0..1..#divisions(); }
pointAtParameter_3 = Curve.PointAtParameter(curve=create, param=code_block_11, lacing=CrossProduct)
create_2 = List.Create(translate_2, byStartPointEndPoint_2)
pointAtParameter_4 = Curve.PointAtParameter(curve=create_2, param=code_block_11, lacing=CrossProduct)
code_block_12 = CodeBlock(orientation=cross) { orientation; }
byStartPointEndPoint_8 = AdvanceSteel.Nodes.Beams.StraightBeam.ByStartPointEndPoint(pointAtParameter_3, pointAtParameter_4, code_block_12)
code_block_13 = CodeBlock(x=byStartPointEndPoint_8) { x[0]; 1; "Top bracing"; x[1]; 1; "Bottom bracing"; }
setUserAttribute_7 = AdvanceSteel.Nodes.Util.UserAttribute.SetUserAttribute(code_block_13.out3, code_block_13.out4, code_block_13.out5)
setUserAttribute_8 = AdvanceSteel.Nodes.Util.UserAttribute.SetUserAttribute(code_block_13.out0, code_block_13.out1, code_block_13.out2)
code_block_14 = CodeBlock { -1; }
dropItems_5 = List.DropItems(amount=code_block_14)
map_7 = List.Map(list=pointAtParameter_3, f_x=dropItems_5)
byStartPointEndPoint_9 = Line.ByStartPointEndPoint(startPoint=pointAtParameter_3, endPoint=pointAtParameter_4)
code_block_15 = CodeBlock { 0.5; }
pointAtParameter_5 = Curve.PointAtParameter(curve=byStartPointEndPoint_9, param=code_block_15, lacing=CrossProduct)
code_block_16 = CodeBlock { -1; }
shiftIndices_3 = List.ShiftIndices(amount=code_block_16)
map_8 = List.Map(list=pointAtParameter_5, f_x=shiftIndices_3)
code_block_17 = CodeBlock { 1; }
flatten = List.Flatten(list=map_8, amt=code_block_17)
code_block_18 = CodeBlock { 1; }
dropItems_6 = List.DropItems(amount=code_block_18)
map_9 = List.Map(list=flatten, f_x=dropItems_6)
byStartPointEndPoint_10 = AdvanceSteel.Nodes.Beams.StraightBeam.ByStartPointEndPoint(map_7, map_9, code_block_12)
code_block_19 = CodeBlock(x=byStartPointEndPoint_10) { x[0]; 1; "Right side top bracing"; x[1]; 1; "Right side bottom bracing"; }
setUserAttribute_9 = AdvanceSteel.Nodes.Util.UserAttribute.SetUserAttribute(code_block_19.out3, code_block_19.out4, code_block_19.out5)
setUserAttribute_10 = AdvanceSteel.Nodes.Util.UserAttribute.SetUserAttribute(code_block_19.out0, code_block_19.out1, code_block_19.out2)
code_block_20 = CodeBlock { -1; }
dropItems_7 = List.DropItems(amount=code_block_20)
map_10 = List.Map(list=pointAtParameter_4, f_x=dropItems_7)
byStartPointEndPoint_11 = AdvanceSteel.Nodes.Beams.StraightBeam.ByStartPointEndPoint(map_10, map_9, code_block_12)
code_block_21 = CodeBlock(x=byStartPointEndPoint_11) { x[0]; 1; "Left side top bracing"; x[1]; 1; "Left side bottom bracing"; }
setUserAttribute_11 = AdvanceSteel.Nodes.Util.UserAttribute.SetUserAttribute(code_block_21.out3, code_block_21.out4, code_block_21.out5)
setUserAttribute_12 = AdvanceSteel.Nodes.Util.UserAttribute.SetUserAttribute(code_block_21.out0, code_block_21.out1, code_block_21.out2)
