# Dynamo graph CircularTower.dyn (Dynamo 2.5.0.7186)

# group: Input
height = CodeBlock { 50000; }
divisions = DoubleInput(15)  # graph input
bottom_radius = CodeBlock { 10000; }
top_radius = CodeBlock { 5000; }

z_coordinates = CodeBlock(heigth=height, x=divisions) { 0..heigth..#x; }
byCoordinates = Point.ByCoordinates(z=z_coordinates)
code_block = CodeBlock(a=bottom_radius, b=top_radius, x=divisions) { a..b..#x; }
byCenterPointRadius = Circle.ByCenterPointRadius(centerPoint=byCoordinates, radius=code_block)
pointsAtEqualSegmentLength = Curve.PointsAtEqualSegmentLength(curve=byCenterPointRadius, divisions=divisions)
splitByPoints = Curve.SplitByPoints(curve=byCenterPointRadius, points=pointsAtEqualSegmentLength)

# group: Horizontal bent beams
startPoint = Curve.StartPoint(curve=splitByPoints)
endPoint = Curve.EndPoint(curve=splitByPoints)
code_block_2 = CodeBlock { 0.5; }
pointAtParameter = Curve.PointAtParameter(curve=splitByPoints, param=code_block_2)
ZAxis = Vector.ZAxis()
byStartPointEndPoint = AdvanceSteel.Nodes.Beams.BentBeam.ByStartPointEndPoint(start=startPoint, end=endPoint, ptOnArc=pointAtParameter, vOrientation=ZAxis)

# group: Bracings
startPoint_2 = Curve.StartPoint(curve=splitByPoints)
flatten = List.Flatten(list=startPoint_2)
chop = List.Chop(list=flatten, lengths=divisions)
python_script = Python(IN[0]=chop)
# ---------- python_script.python (17 lines) ----------
import clr
clr.AddReference('ProtoGeometry')
from Autodesk.DesignScript.Geometry import *
#The inputs to this node will be stored as a list in the IN variable.
inp = IN[0]

#Assign your output to the OUT variable

start = []
end = []
for i in range(len(inp)-1):
 for j in range(len(inp)):
  start.append(inp[i][(j+i) %(len(inp[i]))])
  end.append(inp[i+1][(j+i+1) %(len(inp[i]))])
  start.append(inp[i][(j+i) %(len(inp[i]))])
  end.append(inp[i+1][(j+i+len(inp[i])-1) %(len(inp[i]))])
OUT = [start,end]
# ----------------------------------------
code_block_3 = CodeBlock(x=python_script) { x[0]; x[1]; }
byStartPointEndPoint_2 = Line.ByStartPointEndPoint(startPoint=code_block_3.out0, endPoint=code_block_3.out1)
code_block_4 = CodeBlock { 0.5; }
pointAtParameter_2 = Curve.PointAtParameter(curve=byStartPointEndPoint_2, param=code_block_4)
Z = Point.Z(point=pointAtParameter_2)
byCoordinates_2 = Point.ByCoordinates(z=Z)
byTwoPoints = Vector.ByTwoPoints(start=byCoordinates_2, end=pointAtParameter_2)
byStartPointEndPoint_3 = AdvanceSteel.Nodes.Beams.StraightBeam.ByStartPointEndPoint(start=code_block_3.out0, end=code_block_3.out1, vOrientation=byTwoPoints)
