# Dynamo graph Circus.dyn (Dynamo 2.13.1.3887)
# author: Autodesk

# group: Input values
x_coordinate = CodeBlock { 0; }
y_coordinate = CodeBlock { 0; }
z_coordinate = CodeBlock { 0; }
top_radius = DoubleInput(12000)  # graph input
column_height = DoubleInput(3500)  # graph input
divisions = DoubleInput(20)  # graph input
base_radius = DoubleInput(13000)  # graph input

byCoordinates = Point.ByCoordinates(x=x_coordinate, y=y_coordinate, z=z_coordinate)
byCenterPointRadius = Circle.ByCenterPointRadius(centerPoint=byCoordinates, radius=top_radius)
byCoordinates_2 = Vector.ByCoordinates(z=column_height)
translate = Geometry.Translate(geometry=byCenterPointRadius, direction=byCoordinates_2)
divisions_2 = CodeBlock(x=divisions) { x; }
pointsAtEqualSegmentLength = Curve.PointsAtEqualSegmentLength(curve=translate, divisions=divisions_2)
splitByPoints = Curve.SplitByPoints(curve=translate, points=pointsAtEqualSegmentLength)

# group: Roof Beams
startPoint = Curve.StartPoint(curve=splitByPoints)
centerPoint = Circle.CenterPoint(circle=translate)
roof_height = DoubleInput(4000)  # graph input
byCoordinates_3 = Vector.ByCoordinates(z=roof_height)
translate_2 = Geometry.Translate(geometry=centerPoint, direction=byCoordinates_3)
ZAxis = Vector.ZAxis()
byStartPointEndPoint = AdvanceSteel.Nodes.Beams.StraightBeam.ByStartPointEndPoint(start=startPoint, end=translate_2, orientation=ZAxis)
code_block = CodeBlock { 1; "Roof beam"; }
setUserAttribute = AdvanceSteel.Nodes.Util.UserAttribute.SetUserAttribute(steelObject=byStartPointEndPoint, AttIdx=code_block.out0, value=code_block.out1)

# group: Bent Beams
bent_beams = CodeBlock(curve=splitByPoints) { curve; }
startPoint_2 = Curve.StartPoint(curve=bent_beams)
endPoint = Curve.EndPoint(curve=bent_beams)
middle_of_curve = CodeBlock { 0.5; }
pointAtParameter = Curve.PointAtParameter(curve=bent_beams, param=middle_of_curve)
ZAxis_2 = Vector.ZAxis()
byStartPointEndPoint_2 = AdvanceSteel.Nodes.Beams.BentBeam.ByStartPointEndPoint(start=startPoint_2, end=endPoint, ptOnArc=pointAtParameter, orientation=ZAxis_2)
code_block_2 = CodeBlock { 1; "Bent beam"; }
setUserAttribute_2 = AdvanceSteel.Nodes.Util.UserAttribute.SetUserAttribute(steelObject=byStartPointEndPoint_2, AttIdx=code_block_2.out0, value=code_block_2.out1)

byCenterPointRadius_2 = Circle.ByCenterPointRadius(centerPoint=byCoordinates, radius=base_radius)

# group: Columns
pointsAtEqualSegmentLength_2 = Curve.PointsAtEqualSegmentLength(curve=byCenterPointRadius_2, divisions=divisions_2)
splitByPoints_2 = Curve.SplitByPoints(curve=byCenterPointRadius_2, points=pointsAtEqualSegmentLength_2)
startPoint_3 = Curve.StartPoint(curve=splitByPoints_2)
startPoint_4 = Curve.StartPoint(curve=splitByPoints)
code_block_3 = CodeBlock { 0; }
normalAtParameter = Curve.NormalAtParameter(curve=splitByPoints_2, param=code_block_3)
byStartPointEndPoint_3 = AdvanceSteel.Nodes.Beams.StraightBeam.ByStartPointEndPoint(start=startPoint_3, end=startPoint_4, orientation=normalAtParameter)
code_block_4 = CodeBlock { 1; "Column"; }
setUserAttribute_3 = AdvanceSteel.Nodes.Util.UserAttribute.SetUserAttribute(steelObject=byStartPointEndPoint_3, AttIdx=code_block_4.out0, value=code_block_4.out1)
