# Dynamo graph Dome.dyn (Dynamo 2.10.1.3976)
# packages: MeshToolkit 2.0.1

# group: Input Surface
code_block = CodeBlock { Point.ByCoordinates(0,0,0); }
radius = DoubleSlider(15000, range=0..20000 step 0.1)  # graph input
code_block_2 = CodeBlock { 85; 175; 360; }
XAxis = Vector.XAxis()
byCenterPointRadiusAngle = Arc.ByCenterPointRadiusAngle(center=code_block, radius=radius, startAngle=code_block_2.out0, endAngle=code_block_2.out1, normal=XAxis)
ZAxis = Vector.ZAxis()
byRevolve = Surface.ByRevolve(profile=byCenterPointRadiusAngle, axisDirection=ZAxis, sweepAngle=code_block_2.out2)

# group: Triangulate surface with Advance Steel Plates and Beams
code_block_3 = CodeBlock(surface=byRevolve) { surface; }
# note: You need to have Dynamo Mesh Toolkit in order to use this sample. To install, select "Search for a Package" from the Packages menu, and search for MeshToolkit.
mesh_parameters = CodeBlock { 150; 25; }
code_block_4 = CodeBlock { 0.5; }

byGeometry = Autodesk.Dynamo.MeshToolkit.Mesh.ByGeometry(inputGeometry=code_block_3, tolerance=mesh_parameters.out0, maxGridLines=mesh_parameters.out1)
triangles = Autodesk.Dynamo.MeshToolkit.Mesh.Triangles(mesh=byGeometry)

# group (continued): Triangulate surface with Advance Steel Plates and Beams
perimeterCurves = Surface.PerimeterCurves(surface=triangles)
endPoint = Curve.EndPoint(curve=perimeterCurves)
byPoints = Polygon.ByPoints(points=endPoint)
byPolygon = AdvanceSteel.Nodes.Plates.Plate.ByPolygon(poly=byPoints)

edges = Autodesk.Dynamo.MeshToolkit.Mesh.Edges(mesh=byGeometry)

# group (continued): Triangulate surface with Advance Steel Plates and Beams
startPoint = Curve.StartPoint(curve=edges)
endPoint_2 = Curve.EndPoint(curve=edges)
pointAtParameter = Curve.PointAtParameter(curve=edges, param=code_block_4)
normalAtPoint = Surface.NormalAtPoint(surface=code_block_3, point=pointAtParameter)
byStartPointEndPoint = AdvanceSteel.Nodes.Beams.StraightBeam.ByStartPointEndPoint(start=startPoint, end=endPoint_2, orientation=normalAtPoint)

# group: UserAttibutes
code_block_5 = CodeBlock { 1; "Glass"; "Pipe"; }
setUserAttribute = AdvanceSteel.Nodes.Util.UserAttribute.SetUserAttribute(steelObject=byPolygon, AttIdx=code_block_5.out0, value=code_block_5.out1)
setUserAttribute_2 = AdvanceSteel.Nodes.Util.UserAttribute.SetUserAttribute(steelObject=byStartPointEndPoint, AttIdx=code_block_5.out0, value=code_block_5.out2)
