# Dynamo graph Electrical_Tower.dyn (Dynamo 2.5.2.7915)

# group: Create Lines for Tower Create Planes Intersection line with plane
code_block = CodeBlock { Point.ByCoordinates(0,0,0); }
XY = Plane.XY()
code_block_2 = CodeBlock { 0; 5000; 10000; 15000; 20000; 25000; }
list_create = List.Create(item0=code_block_2.out0, item1=code_block_2.out1, item2=code_block_2.out2, item3=code_block_2.out3, item4=code_block_2.out4, item5=code_block_2.out5)
offset = Plane.Offset(plane=XY, dist=list_create)
code_block_3 = CodeBlock { 10000; 25000; 5000; 7500; }
byWidthLength = Rectangle.ByWidthLength(plane=offset, width=code_block_3.out2, length=code_block_3.out2)
explode = Geometry.Explode(geometry=byWidthLength)
startPoint = Curve.StartPoint(curve=explode)
endPoint = Curve.EndPoint(curve=explode)
ZAxis = Vector.ZAxis()
byStartPointEndPoint = AdvanceSteel.Nodes.Beams.StraightBeam.ByStartPointEndPoint(start=startPoint, end=endPoint, orientation=ZAxis)
byWidthLength_2 = Rectangle.ByWidthLength(plane=XY, width=code_block_3.out0, length=code_block_3.out0)
explode_2 = Geometry.Explode(geometry=byWidthLength_2)
startPoint_2 = Curve.StartPoint(curve=explode_2)
ZAxis_2 = Vector.ZAxis()
byStartPointEndPoint_2 = AdvanceSteel.Nodes.Beams.StraightBeam.ByStartPointEndPoint(start=startPoint_2, end=startPoint, orientation=ZAxis_2)
endPoint_2 = Curve.EndPoint(curve=explode_2)
