# Dynamo graph GemetricFunctions.dyn (Dynamo 2.5.2.7915)

code_block = CodeBlock()
# ---------- code_block.designscript (5 lines) ----------
Point.ByCoordinates(0,0,0);
Point.ByCoordinates(2000,0,500);
Point.ByCoordinates(1001,0,0);
Vector.ZAxis();
Vector.XAxis();
# ----------------------------------------
straight_beam_properties = ASPropertiesStraightBeam("Straight Beam Material")
code_block_2 = CodeBlock { "250"; }
byNameAndValue = AdvanceSteel.Nodes.Util.Property.ByNameAndValue(propertyType=straight_beam_properties, propertyValue=code_block_2)
list_create = List.Create(item0=byNameAndValue)
byStartPointEndPoint = AdvanceSteel.Nodes.Beams.StraightBeam.ByStartPointEndPoint(start=code_block.out0, end=code_block.out1, orientation=code_block.out3, additionalBeamParameters=list_create)
steelObjectResolution = SteelObjectResolution("Detailed")
code_block_3 = CodeBlock { DesignScript.Plane.ByOriginNormal(Point.ByCoordinates(1000,0,0),Vector.XAxis()); }
cutElementByPlane = AdvanceSteel.Nodes.Util.Geometry.CutElementByPlane(steelObject=byStartPointEndPoint, bodyResolution=steelObjectResolution, intersectionPlane=code_block_3)
getPropertyByElement = AdvanceSteel.Nodes.Util.Property.GetPropertyByElement(steelObject=byStartPointEndPoint, propertyType=straight_beam_properties)
steelObjectResolution_2 = SteelObjectResolution("Normal")
code_block_4 = CodeBlock { Point.ByCoordinates(500,50,0); Point.ByCoordinates(2000,0,1500); }
byStartPointEndPoint_2 = Line.ByStartPointEndPoint(startPoint=code_block_4.out0, endPoint=code_block_4.out1)
intersectElementByLine = AdvanceSteel.Nodes.Util.Geometry.IntersectElementByLine(steelObject=byStartPointEndPoint, bodyResolution=steelObjectResolution_2, line=byStartPointEndPoint_2)
cutSystemLineByPlane = AdvanceSteel.Nodes.Util.Geometry.CutSystemLineByPlane(steelObject=byStartPointEndPoint, intersectionPlane=code_block_3)
code_block_5 = CodeBlock { Point.ByCoordinates(0,0,0); Point.ByCoordinates(0,100,0); Point.ByCoordinates(500,90,100); }
code_block_6 = CodeBlock { Vector.XAxis(); 100; 200; 300; }
list_create_2 = List.Create(item0=code_block_6.out1, item1=code_block_6.out2, item2=code_block_6.out3)
getPlaneOffsetByCentre = AdvanceSteel.Nodes.Util.Geometry.GetPlaneOffsetByCentre(centrePoint=code_block_5.out1, planeNormal=code_block_6.out0, distance=list_create_2)
getMidBetweenPoints = AdvanceSteel.Nodes.Util.Geometry.GetMidBetweenPoints(firstPoint=code_block_5.out0, secondPoint=code_block_5.out1)
byStartPointEndPoint_3 = Line.ByStartPointEndPoint(startPoint=code_block_5.out0, endPoint=code_block_5.out1)
orthoProjectPointToLine = AdvanceSteel.Nodes.Util.Geometry.OrthoProjectPointToLine(point=code_block_5.out2, line=byStartPointEndPoint_3)
watch = Watch(orthoProjectPointToLine.IsOnline)
watch_2 = Watch(orthoProjectPointToLine.FoundPoint)
