# Dynamo graph Gratings.dyn (Dynamo 2.5.2.7915)

# group: Bar Grating
code_block = CodeBlock { 0; }
byCoordinates = Point.ByCoordinates(x=code_block, y=code_block, z=code_block)
code_block_2 = CodeBlock { 3000; }
byCoordinates_2 = Point.ByCoordinates(x=code_block_2, y=code_block, z=code_block)
byStartPointEndPoint = Line.ByStartPointEndPoint(startPoint=byCoordinates, endPoint=byCoordinates_2)
code_block_3 = CodeBlock { 1; }
byCoordinates_3 = Vector.ByCoordinates(x=code_block, y=code_block, z=code_block_3)
byLine = AdvanceSteel.Nodes.Gratings.BarGrating.ByLine(line=byStartPointEndPoint, planDirection=byCoordinates_3)

# group: Standard Grating
code_block_4 = CodeBlock { 0; }
byCoordinates_4 = Point.ByCoordinates(x=code_block_4, y=code_block_4, z=code_block_4)
code_block_5 = CodeBlock { 1; }
byCoordinates_5 = Vector.ByCoordinates(x=code_block_5, y=code_block_4, z=code_block_4)
byCoordinates_6 = Vector.ByCoordinates(x=code_block_4, y=code_block_5, z=code_block_4)
byOriginVectors = CoordinateSystem.ByOriginVectors(origin=byCoordinates_4, xAxis=byCoordinates_5, yAxis=byCoordinates_6)
code_block_6 = CodeBlock { "Webforge Mild Steel"; }
code_block_7 = CodeBlock { "Webforge_Mild _Steel_166"; }
byCS = AdvanceSteel.Nodes.Gratings.StandardGrating.ByCS(coordinateSystem=byOriginVectors, gratingClass=code_block_6, gratingName=code_block_7)

# group: Multiple Bar Grating by Line
code_block_8 = CodeBlock { 0; }
byCoordinates_7 = Point.ByCoordinates(x=code_block_8, y=code_block_8, z=code_block_8)
code_block_9 = CodeBlock { 3000; }
byCoordinates_8 = Point.ByCoordinates(x=code_block_9, y=code_block_8, z=code_block_8)
byStartPointEndPoint_2 = Line.ByStartPointEndPoint(startPoint=byCoordinates_7, endPoint=byCoordinates_8)
code_block_10 = CodeBlock { 0; }
code_block_11 = CodeBlock { 1000; }
byCoordinates_9 = Point.ByCoordinates(x=code_block_10, y=code_block_11, z=code_block_10)
code_block_12 = CodeBlock { 3000; }
byCoordinates_10 = Point.ByCoordinates(x=code_block_12, y=code_block_11, z=code_block_10)
byStartPointEndPoint_3 = Line.ByStartPointEndPoint(startPoint=byCoordinates_9, endPoint=byCoordinates_10)
list_create = List.Create(item0=byStartPointEndPoint_2, item1=byStartPointEndPoint_3)
code_block_13 = CodeBlock { 1; }
byCoordinates_11 = Vector.ByCoordinates(x=code_block_8, y=code_block_8, z=code_block_13)
byLine_2 = AdvanceSteel.Nodes.Gratings.BarGrating.ByLine(line=list_create, planDirection=byCoordinates_11)

# group: Variable Grating Rectangular
code_block_14 = CodeBlock { 0; }
byCoordinates_12 = Point.ByCoordinates(x=code_block_14, y=code_block_14, z=code_block_14)
code_block_15 = CodeBlock { 1; }
byCoordinates_13 = Vector.ByCoordinates(x=code_block_15, y=code_block_14, z=code_block_14)
byCoordinates_14 = Vector.ByCoordinates(x=code_block_14, y=code_block_15, z=code_block_14)
byOriginVectors_2 = CoordinateSystem.ByOriginVectors(origin=byCoordinates_12, xAxis=byCoordinates_13, yAxis=byCoordinates_14)
code_block_16 = CodeBlock { "Webforge Mild Steel"; }
code_block_17 = CodeBlock { "Webforge_Mild _Steel_299"; }
code_block_18 = CodeBlock { 1000; }
code_block_19 = CodeBlock { 3000; }
byRectangularByCS = AdvanceSteel.Nodes.Gratings.VariableGrating.ByRectangularByCS(coordinateSystem=byOriginVectors_2, gratingClassName=code_block_16, gratingName=code_block_17, width=code_block_18, length=code_block_19)

# group: Variable Grating by Points
code_block_20 = CodeBlock { "Webforge Mild Steel"; }
code_block_21 = CodeBlock { "Webforge_Mild _Steel_299"; }
code_block_22 = CodeBlock()
# ---------- code_block_22.designscript (7 lines) ----------
Point.ByCoordinates(0, 0, 0);
Point.ByCoordinates(500, 0, 0);
Point.ByCoordinates(500, 500, 100);
Point.ByCoordinates(0, 500, 100);
Point.ByCoordinates(1000, 500, 100);
Point.ByCoordinates(1000, 1000, 0);
Point.ByCoordinates(500, 1000, 0);
# ----------------------------------------
create = List.Create(item0=code_block_22.out0, item1=code_block_22.out1, item2=code_block_22.out2, item3=code_block_22.out3)
byPoints = Polygon.ByPoints(points=create)
byPolygon = AdvanceSteel.Nodes.Gratings.VariableGrating.ByPolygon(gratingClassName=code_block_20, gratingName=code_block_21, poly=byPoints)
