# Dynamo graph PlateVertex.dyn (Dynamo 2.5.2.7915)

# group: DATA IN
# note: Import information / data from others
code_block = CodeBlock { Point.ByCoordinates(1500, 0, 0); Vector.XAxis(); Vector.YAxis(); Vector.ZAxis(); }
code_block_2 = CodeBlock { 350.0; 300.00; }

# group: SET
# note: Set or Override Parameter in Civil 3D
byOriginVectors = CoordinateSystem.ByOriginVectors(origin=code_block.out0, xAxis=code_block.out1, yAxis=code_block.out2, zAxis=code_block.out3)

# group: CREATE
# note: Create object in Civil 3D
byRectanglarByCS = AdvanceSteel.Nodes.Plates.Plate.ByRectanglarByCS(coordinateSystem=byOriginVectors, length=code_block_2.out0, width=code_block_2.out1)

# group: CREATE
code_block_3 = CodeBlock { 51; 0; 1; 2; 3; }
# note: Create object in Civil 3D
byRadius = AdvanceSteel.Nodes.Modifications.PlateVertexCut.ByRadius(element=byRectanglarByCS, radius=code_block_3.out0, cornerIndex=code_block_3.out2)

# group: DATA IN
# note: Import information / data from others
code_block_4 = CodeBlock { Point.ByCoordinates(2500, 0, 0); Vector.XAxis(); Vector.YAxis(); Vector.ZAxis(); }
code_block_5 = CodeBlock { 350.0; 300.00; }

# group: SET
# note: Set or Override Parameter in Civil 3D
byOriginVectors_2 = CoordinateSystem.ByOriginVectors(origin=code_block_4.out0, xAxis=code_block_4.out1, yAxis=code_block_4.out2, zAxis=code_block_4.out3)

# group: CREATE
# note: Create object in Civil 3D
byRectanglarByCS_2 = AdvanceSteel.Nodes.Plates.Plate.ByRectanglarByCS(coordinateSystem=byOriginVectors_2, length=code_block_5.out0, width=code_block_5.out1)

# group: SET
# note: Set or Override Parameter in Civil 3D
code_block_6 = CodeBlock { 50; 0; 1; 2; 3; 175; }

# group: CREATE
# note: Create object in Civil 3D
byChamfer = AdvanceSteel.Nodes.Modifications.PlateVertexCut.ByChamfer(element=byRectanglarByCS_2, length1=code_block_6.out0, length2=code_block_6.out5, cornerIndex=code_block_6.out3)

# group: DATA IN
# note: Import information / data from others
code_block_7 = CodeBlock()
# ---------- code_block_7.designscript (4 lines) ----------
Point.ByCoordinates(200, 0, 0);
Point.ByCoordinates(501, 0, 0);
Point.ByCoordinates(501, 500, 100);
Point.ByCoordinates(0, 500, 100);
# ----------------------------------------

# group: SET
# note: Set or Override Parameter in Civil 3D
create = List.Create(item0=code_block_7.out0, item1=code_block_7.out1, item2=code_block_7.out2, item3=code_block_7.out3)
byPoints = Polygon.ByPoints(points=create)

# group: CREATE
# note: Create object in Civil 3D
byPolygon = AdvanceSteel.Nodes.Plates.Plate.ByPolygon(poly=byPoints)

# group: CREATE
# note: Create object in Civil 3D
byChamfer_2 = AdvanceSteel.Nodes.Modifications.PlateVertexCut.ByChamfer(element=byPolygon, length1=code_block_6.out0, length2=code_block_6.out5, cornerIndex=code_block_6.out4)
