# Dynamo graph Plates.dyn (Dynamo 2.0.1.5055)

code_block = CodeBlock()
# ---------- code_block.designscript (7 lines) ----------
Point.ByCoordinates(0, 0, 0);
Point.ByCoordinates(500, 0, 0);
Point.ByCoordinates(500, 500, 100);
Point.ByCoordinates(0, 500, 100);
Point.ByCoordinates(1000, 500, 100);
Point.ByCoordinates(1000, 1000, 0);
Point.ByCoordinates(500, 1000, 0);
# ----------------------------------------
create = List.Create(item0=code_block.out0, item1=code_block.out1, item2=code_block.out2, item3=code_block.out3)
byPoints = Polygon.ByPoints(points=create)
byPolygon = AdvanceSteel.Nodes.Plates.Plate.ByPolygon(poly=byPoints)
code_block_2 = CodeBlock { "S235"; }
setMaterial = AdvanceSteel.Nodes.Util.Material.SetMaterial(element=byPolygon, materialName=code_block_2)
create_2 = List.Create(item0=code_block.out2, item1=code_block.out4, item2=code_block.out5, item3=code_block.out6)
byPoints_2 = Polygon.ByPoints(points=create_2)
byPolygon_2 = AdvanceSteel.Nodes.Plates.Plate.ByPolygon(poly=byPoints_2)
code_block_3 = CodeBlock { "S275"; }
setMaterial_2 = AdvanceSteel.Nodes.Util.Material.SetMaterial(element=byPolygon_2, materialName=code_block_3)
