# Dynamo graph Plates_2.dyn (Dynamo 2.5.2.7915)

# group: Poly thickness side
code_block = CodeBlock { 0; 0.5; 1; }
code_block_2 = CodeBlock { 20; }
byPolygon = AdvanceSteel.Nodes.Plates.Plate.ByPolygon(thickness=code_block_2, side=code_block.out2)  # unwired: poly

# group: Poly Side
byPolygon_2 = AdvanceSteel.Nodes.Plates.Plate.ByPolygon(side=code_block.out0)  # unwired: poly
code_block_3 = CodeBlock()
# ---------- code_block_3.designscript (4 lines) ----------
Point.ByCoordinates(0, 0, 0);
Point.ByCoordinates(501, 0, 0);
Point.ByCoordinates(501, 500, 100);
Point.ByCoordinates(0, 500, 100);
# ----------------------------------------
create = List.Create(item0=code_block_3.out0, item1=code_block_3.out1, item2=code_block_3.out2, item3=code_block_3.out3)
byPoints = Polygon.ByPoints(points=create)

# group: CS Length Width and Thickness
code_block_4 = CodeBlock { Vector.XAxis(); Vector.YAxis(); Vector.ZAxis(); }
byOriginVectors = CoordinateSystem.ByOriginVectors(origin=code_block_3.out0, xAxis=code_block_4.out0, yAxis=code_block_4.out1, zAxis=code_block_4.out2)
code_block_5 = CodeBlock { 200; 300; }
byRectanglarByCS = AdvanceSteel.Nodes.Plates.Plate.ByRectanglarByCS(coordinateSystem=byOriginVectors, length=code_block_5.out0, width=code_block_5.out1, thickness=code_block_2, side=code_block.out0)  # unwired: corner
code_block_6 = CodeBlock { 3; }

# group: Plate By Dynamo Line
code_block_7 = CodeBlock()  # same code as code_block_3
byStartPointEndPoint = Line.ByStartPointEndPoint(startPoint=code_block_7.out0, endPoint=code_block_7.out1)
code_block_8 = CodeBlock { 100; Vector.YAxis(); 25; 1; }
byLengthEdge = AdvanceSteel.Nodes.Plates.Plate.ByLengthEdge(normal=code_block_8.out1, width=code_block_8.out0, thickness=code_block_8.out2, side=code_block_8.out3)  # unwired: line

# group: Plate by 2 Diagonal Points
code_block_9 = CodeBlock()
# ---------- code_block_9.designscript (4 lines) ----------
Point.ByCoordinates(100, 50, 0);
Point.ByCoordinates(1500, 500, 0);
Point.ByCoordinates(501, 500, 100);
Point.ByCoordinates(0, 500, 100);
# ----------------------------------------
code_block_10 = CodeBlock { 25; 1; }
byTwoDiagonalPointsByCS = AdvanceSteel.Nodes.Plates.Plate.ByTwoDiagonalPointsByCS(cornerPoint1=code_block_9.out0, cornerPoint2=code_block_9.out1, thickness=code_block_10.out0, side=code_block_10.out1)  # unwired: cs
code_block_11 = CodeBlock { Vector.XAxis(); Vector.YAxis(); Vector.ZAxis(); }
byOriginVectors_2 = CoordinateSystem.ByOriginVectors(origin=code_block_9.out0, xAxis=code_block_11.out0, yAxis=code_block_11.out1, zAxis=code_block_11.out2)

code_block_12 = CodeBlock { Point.ByCoordinates(500, 0, 0); Point.ByCoordinates(1505, 0, 0); Point.ByCoordinates(0, 500, 0); 25; 0; }
byThreePoints = AdvanceSteel.Nodes.Plates.Plate.ByThreePoints(orginPoint=code_block_12.out0, xDirectionPoint=code_block_12.out1, yDirectionPoint=code_block_12.out2, thickness=code_block_12.out3, side=code_block_12.out4)
