# Dynamo graph PolyCurve.dyn (Dynamo 2.5.2.7915)

code_block = CodeBlock()
# ---------- code_block.designscript (5 lines) ----------
Point.ByCoordinates(0,0,0);
Point.ByCoordinates(500,0,0);
Point.ByCoordinates(0,300,0);
Point.ByCoordinates(500,300,0);
Point.ByCoordinates(250,300,0);
# ----------------------------------------
byStartPointEndPoint = Line.ByStartPointEndPoint(startPoint=code_block.out0, endPoint=code_block.out1)
byStartPointEndPoint_2 = Line.ByStartPointEndPoint(startPoint=code_block.out0, endPoint=code_block.out2)
byCenterPointStartPointEndPoint = Arc.ByCenterPointStartPointEndPoint(centerPoint=code_block.out4, startPoint=code_block.out3, endPoint=code_block.out2)
byStartPointEndPoint_3 = Line.ByStartPointEndPoint(startPoint=code_block.out1, endPoint=code_block.out3)
list_create = List.Create(item0=byStartPointEndPoint, item1=byStartPointEndPoint_2, item2=byCenterPointStartPointEndPoint, item3=byStartPointEndPoint_3)
byJoinedCurves = PolyCurve.ByJoinedCurves(curves=list_create)
byPolygon = AdvanceSteel.Nodes.Plates.Plate.ByPolygon()  # unwired: poly
