# Dynamo graph PolygonCut.dyn (Dynamo 2.5.2.7915)

# group: DATA IN
# note: Import information / data from others
code_block = CodeBlock()
# ---------- code_block.designscript (4 lines) ----------
Point.ByCoordinates(0, 0, 0);
Point.ByCoordinates(501, 0, 0);
Point.ByCoordinates(501, 500, 100);
Point.ByCoordinates(0, 500, 100);
# ----------------------------------------

# group: SET
# note: Set or Override Parameter in Civil 3D
create = List.Create(item0=code_block.out0, item1=code_block.out1, item2=code_block.out2, item3=code_block.out3)
byPoints = Polygon.ByPoints(points=create)

# group: DATA IN
# note: Import information / data from others
writable_plate_properties = ASPropertiesPlate("Plate Face Alignment")
code_block_2 = CodeBlock { 0.0; 0.5; 1.0; }
writable_plate_properties_2 = ASPropertiesPlate("Plate Thickness")
code_block_3 = CodeBlock { 25.0; }

# group: SET
# note: Set or Override Parameter in Civil 3D
byNameAndValue = AdvanceSteel.Nodes.Util.Property.ByNameAndValue(propertyType=writable_plate_properties, propertyValue=code_block_2.out0)
byNameAndValue_2 = AdvanceSteel.Nodes.Util.Property.ByNameAndValue(propertyType=writable_plate_properties_2, propertyValue=code_block_3)
list_create = List.Create(item0=byNameAndValue, item1=byNameAndValue_2)

# group: CREATE
# note: Create object in Civil 3D
byPolygon = AdvanceSteel.Nodes.Plates.Plate.ByPolygon(poly=byPoints, additionalPlateParameters=list_create)

code_block_4 = CodeBlock { 201.0; 150.0; 0; 71; }

# group: SET
# note: Set or Override Parameter in Civil 3D
writable_plate_feature = ASPropertiesPlateFeatures("Plate Feature Gap")  # "Writable Plate Feature Properties"
code_block_5 = CodeBlock { 20.0; }
byNameAndValue_3 = AdvanceSteel.Nodes.Util.Property.ByNameAndValue(propertyType=writable_plate_feature, propertyValue=code_block_5)
list_create_2 = List.Create(item0=byNameAndValue_3)

# group: DATA IN
# note: Import information / data from others
code_block_6 = CodeBlock { Vector.XAxis(); Vector.YAxis(); Vector.ZAxis(); }
code_block_7 = CodeBlock { 350.0; 300.00; }

# group: SET
# note: Set or Override Parameter in Civil 3D
byOriginVectors = CoordinateSystem.ByOriginVectors(origin=code_block.out0, xAxis=code_block_6.out0, yAxis=code_block_6.out1, zAxis=code_block_6.out2)

# group: CREATE
# note: Create object in Civil 3D
byRectanglarByCS = AdvanceSteel.Nodes.Plates.Plate.ByRectanglarByCS(coordinateSystem=byOriginVectors, length=code_block_7.out0, width=code_block_7.out1, additionalPlateParameters=list_create)

# group: CREATE
# note: Create object in Civil 3D
byLengthAndWidth = AdvanceSteel.Nodes.Modifications.PlatePolycut.ByLengthAndWidth(element=byPolygon, length=code_block_4.out0, width=code_block_4.out1, corner=code_block_4.out2, additionalPlateFeatureParameters=list_create_2)
byRadius = AdvanceSteel.Nodes.Modifications.PlatePolycut.ByRadius(element=byRectanglarByCS, radius=code_block_4.out3)
