# Dynamo graph RectangularSurface.dyn (Dynamo 1.0.0.1531)

# group: Input Surface
code_block = CodeBlock { 0..25000..#5; }
code_block_2 = CodeBlock(x=code_block) { x[0]; }
number = DoubleInput(0)
byCoordinates = Point.ByCoordinates(x=code_block_2, z=number)
code_block_3 = CodeBlock(x=code_block) { x[1]; }
number_2 = DoubleInput(5000)
byCoordinates_2 = Point.ByCoordinates(x=code_block_3, z=number_2)
code_block_4 = CodeBlock(x=code_block) { x[2]; }
byCoordinates_3 = Point.ByCoordinates(x=code_block_4)
code_block_5 = CodeBlock(x=code_block) { x[3]; }
number_3 = DoubleInput(10000)
byCoordinates_4 = Point.ByCoordinates(x=code_block_5, z=number_3)
code_block_6 = CodeBlock(x=code_block) { x[4]; }
byCoordinates_5 = Point.ByCoordinates(x=code_block_6)
create = List.Create(byCoordinates, byCoordinates_2, byCoordinates_3, byCoordinates_4, byCoordinates_5)
byControlPoints = NurbsCurve.ByControlPoints(create)
number_4 = DoubleInput(15000)
byCoordinates_6 = Vector.ByCoordinates(y=number_4)
extrude = Curve.Extrude(byControlPoints, byCoordinates_6)

# group: Grid of beams
ZAxis = Vector.ZAxis()
input_surface = CodeBlock(surface=extrude) { surface; }
number_5 = DoubleInput(0)
divisions_on_y_direction = DoubleSlider(17, range=0..50 step 1)
number_6 = DoubleInput(0..1..#x, divisions_on_y_direction, lacing=Longest)
byIsoCurveOnSurface = Curve.ByIsoCurveOnSurface(baseSurface=input_surface, direction=number_5, parameter=number_6, lacing=CrossProduct)
flatten = Flatten(byIsoCurveOnSurface)
number_7 = DoubleInput(1)
divisions_on_x_direction = DoubleSlider(16, range=0..50 step 1)
number_8 = DoubleInput(0..1..#x, divisions_on_x_direction, lacing=Longest)
byIsoCurveOnSurface_2 = Curve.ByIsoCurveOnSurface(baseSurface=input_surface, direction=number_7, parameter=number_8, lacing=CrossProduct)
flatten_2 = Flatten(byIsoCurveOnSurface_2)
intersect = Geometry.Intersect(geometry=flatten, other=flatten_2, lacing=CrossProduct)
flatten_3 = Flatten(intersect)
count = List.Count(flatten_3)
div = count / divisions_on_y_direction
chop = List.Chop(list=flatten_3, lengths=div)
count_2 = List.Count(chop)
code_block_7 = CodeBlock(x=count_2) { 0..x-2..1; }
getItemAtIndex = List.GetItemAtIndex(list=chop, index=code_block_7)
code_block_8 = CodeBlock(x=chop, i=code_block_7) { x[i]; }
flatten_4 = Flatten(code_block_8)
code_block_9 = CodeBlock(x=count_2) { 1..x-1..1; }
getItemAtIndex_2 = List.GetItemAtIndex(list=chop, index=code_block_9)
flatten_5 = Flatten(getItemAtIndex_2)
normalAtPoint = Surface.NormalAtPoint(surface=input_surface, point=flatten_4)
byStartPointEndPoint = AdvanceSteel.Nodes.Beams.StraightBeam.ByStartPointEndPoint(flatten_4, flatten_5, normalAtPoint)
python_script = Python(IN[0]=chop)
# ---------- python_script.python (15 lines) ----------
import clr
clr.AddReference('ProtoGeometry')
from Autodesk.DesignScript.Geometry import *
#The inputs to this node will be stored as a list in the IN variable.
inp = IN[0]

#Assign your output to the OUT variable

start = []
end = []
for i in range(len(inp)):
 for j in range(len(inp[i])-1):
  start.append(inp[i][j])
  end.append(inp[i][j+1])
OUT = [start,end]
# ----------------------------------------
code_block_10 = CodeBlock(x=python_script) { x[0]; x[1]; }
normalAtPoint_2 = Surface.NormalAtPoint(surface=input_surface, point=code_block_10.out0)
byStartPointEndPoint_2 = AdvanceSteel.Nodes.Beams.StraightBeam.ByStartPointEndPoint(code_block_10.out0, code_block_10.out1, normalAtPoint_2)
