# Dynamo graph SaddleSurface.dyn (Dynamo 4.0.0.3277)
# author: Autodesk

# group: Input Surface
code_block = CodeBlock { -25000; }
code_block_2 = CodeBlock { 25000; }
code_block_3 = CodeBlock { 1000; }
range = Range(start=code_block, end=code_block_2, step=code_block_3, lacing=Longest)
code_block_4 = CodeBlock { -25000; }
code_block_5 = CodeBlock { 25000; }
code_block_6 = CodeBlock { 1000; }
range_2 = Range(start=code_block_4, end=code_block_5, step=code_block_6, lacing=Longest)
byCoordinates = Point.ByCoordinates(x=range, y=range_2, lacing=CrossProduct)
X = Point.X(point=byCoordinates)
Y = Point.Y(point=byCoordinates)
code_block_7 = CodeBlock { 250; }
code_block_8 = CodeBlock { 190; }
code_block_9 = CodeBlock { 0; }
formula = CodeBlock(x=X, a=code_block_7, y=Y, b=code_block_8, c=code_block_9) { temp_proc_var_ = (((DSCore.Math.Pow(x, 2)) / (DSCore.Math.Pow(a, 2))) - ((DSCore.Math.Pow(y, 2)) / (DSCore.Math.Pow(b, 2)))) + c; }
byCoordinates_2 = Point.ByCoordinates(x=X, y=Y, z=formula)
byControlPoints = NurbsSurface.ByControlPoints(controlVertices=byCoordinates_2)

# group: Grid of beams
input_surface = CodeBlock(surface=byControlPoints) { surface; }
number = DoubleInput(0)  # graph input
divisions_on_y_direction = DoubleSlider(17, range=0..50 step 1)  # graph input
code_block_10 = CodeBlock(x=divisions_on_y_direction) { 0..1..#x; }
byIsoCurveOnSurface = Curve.ByIsoCurveOnSurface(baseSurface=input_surface, direction=number, parameter=code_block_10, lacing=CrossProduct)
flatten = List.Flatten(list=byIsoCurveOnSurface)
number_2 = DoubleInput(1)  # graph input
divisions_on_x_direction = DoubleSlider(16, range=0..50 step 1)  # graph input
code_block_11 = CodeBlock(x=divisions_on_x_direction) { 0..1..#x; }
byIsoCurveOnSurface_2 = Curve.ByIsoCurveOnSurface(baseSurface=input_surface, direction=number_2, parameter=code_block_11, lacing=CrossProduct)
flatten_2 = List.Flatten(list=byIsoCurveOnSurface_2)
intersect = Geometry.Intersect(geometry=flatten, other=flatten_2, lacing=CrossProduct)
flatten_3 = List.Flatten(list=intersect)
count = List.Count(list=flatten_3)
div = count / divisions_on_y_direction
chop = List.Chop(list=flatten_3, lengths=div)
count_2 = List.Count(list=chop)
code_block_12 = CodeBlock(x=count_2) { 0..x-2..1; }
getItemAtIndex = List.GetItemAtIndex(list=chop, index=code_block_12)
code_block_13 = CodeBlock(x=chop, i=code_block_12) { x[i]; }
flatten_4 = List.Flatten(list=code_block_13)
code_block_14 = CodeBlock(x=count_2) { 1..x-1..1; }
getItemAtIndex_2 = List.GetItemAtIndex(list=chop, index=code_block_14)
flatten_5 = List.Flatten(list=getItemAtIndex_2)
normalAtPoint = Surface.NormalAtPoint(surface=input_surface, point=flatten_4)
byStartPointEndPoint = AdvanceSteel.Nodes.Beams.StraightBeam.ByStartPointEndPoint(start=flatten_4, end=flatten_5, orientation=normalAtPoint)
python_script = Python(IN[0]=chop)  # PythonNet3
# ---------- python_script.python (15 lines) ----------
import clr
clr.AddReference('ProtoGeometry')
from Autodesk.DesignScript.Geometry import *
#The inputs to this node will be stored as a list in the IN variable.
inp = IN[0]

#Assign your output to the OUT variable

start = []
end = []
for i in range(len(inp)):
 for j in range(len(inp[i])-1):
  start.append(inp[i][j])
  end.append(inp[i][j+1])
OUT = [start,end]
# ----------------------------------------
code_block_15 = CodeBlock(x=python_script) { x[0]; x[1]; }
normalAtPoint_2 = Surface.NormalAtPoint(surface=input_surface, point=code_block_15.out0)
byStartPointEndPoint_2 = AdvanceSteel.Nodes.Beams.StraightBeam.ByStartPointEndPoint(start=code_block_15.out0, end=code_block_15.out1, orientation=normalAtPoint_2)
