# Dynamo graph Selection.dyn (Dynamo 2.5.2.7915)

selectSteelObjects = ASObjectSelection()  # 2 picked in the model
advance_steel_object_types = ASObjecTypes("Advance Steel Plate")
list_create = List.Create(item0=advance_steel_object_types)
filterSelectionByType = AdvanceSteel.Nodes.Selection.ObjectSelection.FilterSelectionByType(objectTypeFilters=list_create)  # unwired: currentSelectionSet
advance_steel_object_types_2 = ASObjecTypes("Advance Steel Bent Beam")
list_create_2 = List.Create(item0=advance_steel_object_types_2)
filterSelectionByType_2 = AdvanceSteel.Nodes.Selection.ObjectSelection.FilterSelectionByType(objectTypeFilters=list_create_2)  # unwired: currentSelectionSet
advance_steel_object_types_3 = ASObjecTypes("Advance Steel Straight Beam")
list_create_3 = List.Create(item0=advance_steel_object_types_3)
filterSelectionByType_3 = AdvanceSteel.Nodes.Selection.ObjectSelection.FilterSelectionByType(objectTypeFilters=list_create_3)  # unwired: currentSelectionSet
straight_beam_properties_get = ASGetPropertiesStraightBeam("Beam Material")
getPropertyByElement = AdvanceSteel.Nodes.Util.Property.GetPropertyByElement(steelObject=filterSelectionByType_3, propertyType=straight_beam_properties_get)
selectSteelObjects_2 = ASObjectSelection()  # 3 picked in the model
getElementProperties = AdvanceSteel.Nodes.Util.Property.GetElementProperties()  # unwired: steelObject
code_block = CodeBlock { "gg"; }
getPropertyByElement_2 = AdvanceSteel.Nodes.Util.Property.GetPropertyByElement()  # unwired: steelObject, propertyType
getPropertiesByElement = AdvanceSteel.Nodes.Util.Property.GetPropertiesByElement()  # unwired: steelObject, propertyTypes
getSteelObjectsByType = ASSelectObjecTypes("Advance Steel Straight Beam")
getElementProperties_2 = AdvanceSteel.Nodes.Util.Property.GetElementProperties(steelObject=getSteelObjectsByType)
