# Dynamo graph ShearStuds.dyn (Dynamo 2.5.2.7915)

# group: TEMP
# note: Work in progress / To delete

# group: SET
# note: Set or Override Parameter in Civil 3D

# group: PROCESS
# note: Dynamo data manipulation

# group: GEOM
# note: Dynamo geometry creation

# group: DATA IN
# note: Import information / data from others

# group: DATA OUT
# note: Export information / data to others

# group: GET
# note: Get information / data from Civil 3D

# group: CREATE
# note: Create object in Civil 3D

code_block = CodeBlock { 20; 3; 4; 150; 200; }

# group: SET
# note: Set orginal Plate Creation Parameters
code_block_2 = CodeBlock()
# ---------- code_block_2.designscript (3 lines) ----------
CoordinateSystem.ByOriginVectors(Point.ByCoordinates(1500,0,0), Vector.XAxis(), Vector.YAxis(), Vector.ZAxis());
Point.ByCoordinates(1500,0,0);
Vector.ZAxis();
# ----------------------------------------
code_block_3 = CodeBlock { 300; 300; }
code_block_4 = CodeBlock { 500; 650; 20; 0; -1; 1; }
code_block_5 = CodeBlock { 22; 150; }
weld_connection_type = WeldConnectionType("InShop")

# group: GEOM
# note: Dynamo geometry creation
byOriginNormal = Plane.ByOriginNormal(origin=code_block_2.out1, normal=code_block_2.out2)
byWidthLength = Rectangle.ByWidthLength(plane=byOriginNormal, width=code_block_3.out0, length=code_block_3.out1)

# group: SET
# note: Set Asdditional Parameters
shear_stud_properties = ASPropertiesShearStud("Stud Standard")
code_block_6 = CodeBlock { "Nelson S3L"; "Mild Steel"; }
createParameter = AdvanceSteel.Nodes.Util.Properties.CreateParameter(selectedKey=shear_stud_properties, propertyValue=code_block_6.out0)
shear_stud_properties_2 = ASPropertiesShearStud("Stud Grade")
createParameter_2 = AdvanceSteel.Nodes.Util.Properties.CreateParameter(selectedKey=shear_stud_properties_2, propertyValue=code_block_6.out1)
list_create = List.Create(item0=createParameter, item1=createParameter_2)
shear_stud_properties_3 = ASPropertiesShearStud("Display Stud As Solid")
code_block_7 = CodeBlock { 2; }
createParameter_3 = AdvanceSteel.Nodes.Util.Properties.CreateParameter(selectedKey=shear_stud_properties_3, propertyValue=code_block_7)

# group: CREATE
# note: Create Plate and Pass to ShearStud Creation
byRectanglarByCS = AdvanceSteel.Nodes.Plates.Plate.ByRectanglarByCS(coordinateSystem=code_block_2.out0, length=code_block_4.out0, width=code_block_4.out1, thickness=code_block_4.out2, side=code_block_4.out3, corner=code_block_4.out4)
byRectangle = AdvanceSteel.Nodes.ConnectionObjects.ShearStuds.RectangularShearStudsPattern.ByRectangle(rectangle=byWidthLength, objectToConnect=byRectanglarByCS, studLength=code_block_5.out1, studDiameter=code_block_5.out0, ShearStudConnectionType=weld_connection_type, ListOfdAdditionalShearStudParameters=list_create)

# group: SET
# note: Set or Override Parameter in Civil 3D
code_block_8 = CodeBlock()
# ---------- code_block_8.designscript (3 lines) ----------
CoordinateSystem.ByOriginVectors(Point.ByCoordinates(0,0,0), Vector.XAxis(), Vector.YAxis(), Vector.ZAxis());
Point.ByCoordinates(0,0,0);
Vector.ZAxis();
# ----------------------------------------
code_block_9 = CodeBlock { 500; 500; 20; 0; -1; 1; }
code_block_10 = CodeBlock { 22; 150; }
code_block_11 = CodeBlock { 3; 4; 200; 200; }
weld_connection_type_2 = WeldConnectionType("InShop")

# group: SET
shear_stud_properties_4 = ASPropertiesShearStud("Stud Standard")
code_block_12 = CodeBlock { "Nelson S3L"; "Mild Steel"; }
# note: Set or Override Parameter in Civil 3D
createParameter_4 = AdvanceSteel.Nodes.Util.Properties.CreateParameter(selectedKey=shear_stud_properties_4, propertyValue=code_block_12.out0)
shear_stud_properties_5 = ASPropertiesShearStud("Stud Grade")
createParameter_5 = AdvanceSteel.Nodes.Util.Properties.CreateParameter(selectedKey=shear_stud_properties_5, propertyValue=code_block_12.out1)
list_create_2 = List.Create(item0=createParameter_4, item1=createParameter_5)

# group: CREATE
byRectanglarByCS_2 = AdvanceSteel.Nodes.Plates.Plate.ByRectanglarByCS(coordinateSystem=code_block_8.out0, length=code_block_9.out0, width=code_block_9.out1, thickness=code_block_9.out2, side=code_block_9.out3, corner=code_block_9.out4)
# note: Create object in Civil 3D
atCentrePoint = AdvanceSteel.Nodes.ConnectionObjects.ShearStuds.RectangularShearStudsPattern.AtCentrePoint(connectionPoint=code_block_8.out1, shearStudCS=code_block_8.out0, objectToConnect=byRectanglarByCS_2, studLength=code_block_10.out1, studDiameter=code_block_10.out0, studSpacingX=code_block_11.out2, studSpacingY=code_block_11.out3, ShearStudConnectionType=weld_connection_type_2, ListOfdAdditionalShearStudParameters=list_create_2)

# group: SET
# note: Set or Override Parameter in Civil 3D
code_block_13 = CodeBlock()
# ---------- code_block_13.designscript (3 lines) ----------
CoordinateSystem.ByOriginVectors(Point.ByCoordinates(0,1500,0), Vector.XAxis(), Vector.YAxis(), Vector.ZAxis());
Point.ByCoordinates(0,1500,0);
Vector.ZAxis();
# ----------------------------------------
code_block_14 = CodeBlock { 150; }
code_block_15 = CodeBlock { Vector.XAxis(); }
code_block_16 = CodeBlock { 500; 500; 20; 0; -1; 1; }
code_block_17 = CodeBlock { 22; 150; 10; }
weld_connection_type_3 = WeldConnectionType("InShop")

# group: GEOM
# note: Dynamo geometry creation
byCenterPointRadiusNormal = Circle.ByCenterPointRadiusNormal(centerPoint=code_block_13.out1, radius=code_block_14, normal=code_block_13.out2)

# group: SET
shear_stud_properties_6 = ASPropertiesShearStud("Stud Standard")
code_block_18 = CodeBlock { "Nelson S3L"; "Mild Steel"; }
# note: Set or Override Parameter in Civil 3D
createParameter_6 = AdvanceSteel.Nodes.Util.Properties.CreateParameter(selectedKey=shear_stud_properties_6, propertyValue=code_block_18.out0)
shear_stud_properties_7 = ASPropertiesShearStud("Stud Grade")
createParameter_7 = AdvanceSteel.Nodes.Util.Properties.CreateParameter(selectedKey=shear_stud_properties_7, propertyValue=code_block_18.out1)
shear_stud_properties_8 = ASPropertiesShearStud("Display Stud As Solid")
code_block_19 = CodeBlock { 2; }
createParameter_8 = AdvanceSteel.Nodes.Util.Properties.CreateParameter(selectedKey=shear_stud_properties_8, propertyValue=code_block_19)
list_create_3 = List.Create(item0=createParameter_6, item1=createParameter_7, item2=createParameter_8)

# group: CREATE
byRectanglarByCS_3 = AdvanceSteel.Nodes.Plates.Plate.ByRectanglarByCS(coordinateSystem=code_block_13.out0, length=code_block_16.out0, width=code_block_16.out1, thickness=code_block_16.out2, side=code_block_16.out3, corner=code_block_16.out4)
# note: Create object in Civil 3D
byCircle = AdvanceSteel.Nodes.ConnectionObjects.ShearStuds.CircularShearStudsPattern.ByCircle(circle=byCenterPointRadiusNormal, referenceVector=code_block_15, objectToConnect=byRectanglarByCS_3, studLength=code_block_17.out1, studDiameter=code_block_17.out0, noOfShearStudsInCircle=code_block_17.out2, ShearStudConnectionType=weld_connection_type_3, ListOfdAdditionalShearStudParameters=list_create_3)
