# Dynamo graph Slabs.dyn (Dynamo 2.5.2.7915)

# group: Slab By Polygon
code_block = CodeBlock()
# ---------- code_block.designscript (4 lines) ----------
Point.ByCoordinates(500, 100, 0);
Point.ByCoordinates(5100, 0, 0);
Point.ByCoordinates(5100, 5000, 0);
Point.ByCoordinates(500, 4901, 0);
# ----------------------------------------
create = List.Create(item0=code_block.out0, item1=code_block.out1, item2=code_block.out2, item3=code_block.out3)
byPoints = Polygon.ByPoints(points=create)
code_block_2 = CodeBlock { 200; }
code_block_3 = CodeBlock { 1; }
byPolygon = AdvanceSteel.Nodes.Concrete.Slabs.ByPolygon(poly=byPoints, thickness=code_block_2, side=code_block_3)

code_block_4 = CodeBlock()
# ---------- code_block_4.designscript (4 lines) ----------
Point.ByCoordinates(-33.58,8495.24,0.00);
Point.ByCoordinates(4497.61,7356.07,0.00);
Point.ByCoordinates(8993.92,8696.73,0.00);
Point.ByCoordinates(4818.27,13972.81,0.00);
# ----------------------------------------
create_2 = List.Create(item0=code_block_4.out0, item1=code_block_4.out1, item2=code_block_4.out2, item3=code_block_4.out3)
byPoints_2 = Polygon.ByPoints(points=create_2)
code_block_5 = CodeBlock { 200; }
code_block_6 = CodeBlock { 1; }
byPolygon_2 = AdvanceSteel.Nodes.Concrete.Slabs.ByPolygon(poly=byPoints_2, thickness=code_block_5, side=code_block_6)
