# Dynamo graph SpecialParts.dyn (Dynamo 2.5.2.7915)

special_parts_properties = ASPropertiesSpecialParts("Select Special Part Property...")
code_block = CodeBlock { CoordinateSystem.ByOrigin(0,0,0); "agnut24"; 1; }
byCSAndBlockName = AdvanceSteel.Nodes.NonSteelItems.SpecialPart.ByCSAndBlockName(coordinateSystem=code_block.out0, blockName=code_block.out1, scale=code_block.out2)
