# Dynamo graph Walls.dyn (Dynamo 2.5.2.7915)

# group: Face Length Height by Plane
code_block = CodeBlock { Point.ByCoordinates(0,7500,0); Point.ByCoordinates(0,5000,3000); Vector.ZAxis(); }
byOriginNormal = Plane.ByOriginNormal(origin=code_block.out1, normal=code_block.out2)
code_block_2 = CodeBlock { 8500; }
code_block_3 = CodeBlock { 2500; }
code_block_4 = CodeBlock { 250; }
code_block_5 = CodeBlock { 1; }
faceByLengthHeightByPlane = AdvanceSteel.Nodes.Concrete.Walls.FaceByLengthHeightByPlane(plane=byOriginNormal, length=code_block_2, height=code_block_3, thickness=code_block_4, side=code_block_5)

# group: Face Length Height by CS
code_block_6 = CodeBlock { 1; }
code_block_7 = CodeBlock { 0; }
byCoordinates = Vector.ByCoordinates(x=code_block_6, y=code_block_7, z=code_block_7)
byCoordinates_2 = Vector.ByCoordinates(x=code_block_7, y=code_block_6, z=code_block_7)
byOriginVectors = CoordinateSystem.ByOriginVectors(origin=code_block.out0, xAxis=byCoordinates, yAxis=byCoordinates_2)
code_block_8 = CodeBlock { 3000; }
code_block_9 = CodeBlock { 3000; }
code_block_10 = CodeBlock { 300; }
faceByLengthHeightByCS = AdvanceSteel.Nodes.Concrete.Walls.FaceByLengthHeightByCS(coordinateSystem=byOriginVectors, length=code_block_8, height=code_block_9, thickness=code_block_10, side=code_block_5)

# group: Wall At Base Length Height CS
byOriginVectors_2 = CoordinateSystem.ByOriginVectors(origin=code_block.out0, xAxis=byCoordinates, yAxis=byCoordinates_2)
code_block_11 = CodeBlock { 6500; }
atBaseByLengthHeightByCS = AdvanceSteel.Nodes.Concrete.Walls.AtBaseByLengthHeightByCS(coordinateSystem=byOriginVectors_2, length=code_block_11, height=code_block_3, thickness=code_block_4, side=code_block_5)

# group: Wall By Polygon
code_block_12 = CodeBlock()
# ---------- code_block_12.designscript (6 lines) ----------
Point.ByCoordinates(0,7500,0);
Point.ByCoordinates(0,7500,3000);
Point.ByCoordinates(0,10000,3000);
Point.ByCoordinates(0,10000,1000);
Point.ByCoordinates(0,12000,1000);
Point.ByCoordinates(0,12001,0);
# ----------------------------------------
list_create = List.Create(item0=code_block_12.out0, item1=code_block_12.out1, item2=code_block_12.out2, item3=code_block_12.out3, item4=code_block_12.out4, item5=code_block_12.out5)
byPoints = Polygon.ByPoints(points=list_create)
code_block_13 = CodeBlock { 300; }
faceByPolygon = AdvanceSteel.Nodes.Concrete.Walls.FaceByPolygon(poly=byPoints, thickness=code_block_13, side=code_block_5)
